# Grasshopper definition reader and sender.ghx (Grasshopper 1.0.8)
# plug-ins: Karamba3D, Pufferfish, Nautilus

# Reader
button = Button()
path = FilePath("C:\Users\hamid\Documents\GitHub\eWoodX\Webcam detection\sample_output\captures\")
number_slider = Slider(10, range=0..100)  # disabled
button_2 = Button()  # disabled
path_2 = FilePath("C:\Users\hamid\Documents\GitHub\eWoodX\Webcam detection\sample_output\captures\")  # disabled
timber_reader = Python3Script(json_path=path, refresh=Button(), index=Slider(0, range=0..100), capture=button, host="127.0.0.1", port="9998")  # -> out, status, timber_id, timber_contour, timber_corners, timber_holes, length_mm, width_mm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; inputs json_path: String, refresh: Boolean, capture: tree of Boolean, host: String, port: Int32
# ---------- timber_reader: Python ----------
"""
================================================================================
eWoodX - Grasshopper GhPython Component: Single-Timber Reader & Live Capture
================================================================================

Description:
  Reads timber geometry, dimensions, and hand-drawn YOLO annotations from JSON.
  Features a live Button input to remotely trigger capture and measurement
  in 03_timber_measurement_handdraw_yolo.py.

  Timber Number 0 is strictly reserved for Grasshopper captures:
    - Capturing from Grasshopper updates 'timber_00_measurement.json' & 'timber_00.jpg'.
    - Does NOT alter the manual camera counter (timbers 1, 2, 3... remain intact).
    - Designed specifically to work with this single JSON.

How to use in Grasshopper:
1. Place a "GhPython Script" component on the Grasshopper canvas.
2. Configure Component Inputs:
     - capture    : (Item Access, Type Hint: bool) [Button: press to capture live frame]
                    (Also supports names: btn_capture, button, trigger, refresh)
     - json_path  : (Item Access, Type Hint: str, Optional)
                    [Leave disconnected to automatically use reserved timber_00_measurement.json]
     - index      : (Item Access, Type Hint: int, Optional)
                    [Index of timber if file has multiple, default: 0]
     - host       : (Item Access, Type Hint: str, Optional) [Default: 127.0.0.1]
     - port       : (Item Access, Type Hint: int, Optional) [Default: 9998]

3. Configure Component Outputs (Grafted DataTree {0} per timber for full compatibility):
     - timber_contour  : PolylineCurve outline of the timber
     - timber_corners  : 4 Point3d corner points
     - timber_holes    : Inner cutout / hole curves
     - timber_id       : Timber ID (0 for Grasshopper captures)
     - length_mm       : Calibrated length (mm)
     - width_mm        : Calibrated width (mm)
     - thickness_mm    : Timber thickness (mm)
     - surface_area_cm2: Surface area (cm²)
     - side_lengths_mm : Length of 4 sides (mm)
     - color_rgb       : System.Drawing.Color / RGB
     - color_hex       : Hex color string (#rrggbb)
     - defects         : List of defect Point3d
     - drawing_curves  : Hand-drawn shape curves (ellipse, rect, triangle)
     - drawing_centers : Center Point3d of hand-drawn shapes
     - drawing_classes : Class names of shapes ('ellipse', 'rectangle', 'triangle')
     - drawing_sizes   : Dimension string of shapes (e.g. '120.5x80.2mm')
     - drawing_confidences: YOLO detection confidence scores (0.0 - 1.0)
     - table_boundary  : PolylineCurve of physical table workspace
     - markers_corners : ArUco marker boundary curves
     - file_path       : Path to the loaded JSON file
     - status          : Live capture status & connection diagnostics
     - info            : Formatted summary text

4. Paste this entire code into the GhPython component editor.
================================================================================
"""

import os
import glob
import json
import re
import socket
import time
import datetime

# Rhino, Grasshopper & .NET imports with safe fallback for testing outside Rhino
try:
    import Rhino.Geometry as rg
    import System.Drawing as sd
    import Grasshopper
    from Grasshopper.Kernel.Data import GH_Path
    from Grasshopper import DataTree
    IN_RHINO = True
    HAS_DATATREE = True
except ImportError:
    rg = None
    sd = None
    DataTree = None
    GH_Path = None
    IN_RHINO = False
    HAS_DATATREE = False


# ============================================================
# HELPER FUNCTIONS
# ============================================================

def make_grafted_tree(items_per_timber):
    """
    Convert a list of items (where item i belongs to timber i)
    into a Grasshopper DataTree with branch paths {0}, {1}...
    """
    if not HAS_DATATREE or DataTree is None:
        return items_per_timber

    tree = DataTree[object]()
    for i, val in enumerate(items_per_timber):
        path = GH_Path(i)
        if isinstance(val, (list, tuple)):
            for sub_val in val:
                tree.Add(sub_val, path)
        elif val is not None:
            tree.Add(val, path)
    return tree


def find_default_capture_dir():
    """Locate the captures folder across common workspace directories."""
    search_dirs = [
        r"C:\Users\hamid\Documents\GitHub\eWoodX\Webcam detection\sample_output\captures",
        r"C:\Users\hamid\Documents\GitHub\eWoodX\Webcam detection\sample_output",
        os.path.expanduser(r"~\Documents\GitHub\eWoodX\Webcam detection\sample_output\captures"),
        os.path.expanduser(r"~\Documents\GitHub\eWoodX\sample_output\captures"),
        os.path.expanduser(r"~\Documents\GitHub\eWoodX\sample_output"),
        os.path.join(os.path.dirname(os.path.abspath(__file__)), "sample_output", "captures") if "__file__" in globals() and __file__ else "",
        r".\sample_output\captures",
        r".\captures"
    ]
    for s_dir in search_dirs:
        if s_dir and os.path.isdir(s_dir):
            return s_dir
    return None


def natural_sort_key(s):
    """Sort strings with numbers naturally (timber_1, timber_2, ..., timber_10)."""
    return [int(text) if text.isdigit() else text.lower() for text in re.split(r'(\d+)', s)]


def trigger_remote_capture(host="127.0.0.1", port=9998, number=0, timeout=6.0):
    """
    Remotely signal 03_timber_measurement_handdraw_yolo.py to capture and measure.
    Uses TCP socket first (port 9998). If socket fails, uses capture_trigger.json fallback.
    Returns (success: bool, status_msg: str, json_path: str)
    """
    # 1. Primary Method: TCP Socket
    try:
        sock = socket.socket(socket.AF_INET, socket.SOCK_STREAM)
        sock.settimeout(timeout)
        sock.connect((host, int(port)))
        payload = json.dumps({"action": "capture", "number": int(number)}) + "\n"
        sock.sendall(payload.encode("utf-8"))

        raw_resp = sock.recv(4096)
        sock.close()

        if raw_resp:
            resp_str = raw_resp.decode("utf-8", errors="ignore").strip()
            data = json.loads(resp_str)
            if data.get("status") == "success":
                now_str = datetime.datetime.now().strftime("%H:%M:%S")
                j_path = data.get("json_path", "")
                return True, f"Capture OK: Timber #{number:02d} captured and saved at {now_str}", j_path
            else:
                return False, f"Capture error from camera script: {data.get('message', 'Unknown error')}", ""
    except Exception:
        pass

    # 2. Fallback Method: File-based trigger
    cap_dir = find_default_capture_dir()
    if cap_dir and os.path.isdir(cap_dir):
        trig_file = os.path.join(cap_dir, "capture_trigger.json")
        status_file = os.path.join(cap_dir, "capture_status.json")
        target_json = os.path.join(cap_dir, f"timber_{number:02d}_measurement.json")
        start_time = time.time()
        prev_mtime = os.path.getmtime(target_json) if os.path.exists(target_json) else 0

        try:
            with open(trig_file, "w", encoding="utf-8") as tf:
                json.dump({"action": "capture", "number": int(number), "time": start_time}, tf)

            while (time.time() - start_time) < timeout:
                time.sleep(0.1)
                if os.path.exists(status_file):
                    try:
                        with open(status_file, "r", encoding="utf-8") as sf:
                            sdata = json.load(sf)
                        os.remove(status_file)
                        if sdata.get("status") == "success":
                            now_str = datetime.datetime.now().strftime("%H:%M:%S")
                            return True, f"Capture OK: Timber #{number:02d} updated via file trigger at {now_str}", target_json
                    except Exception:
                        pass

                if os.path.exists(target_json) and os.path.getmtime(target_json) > prev_mtime:
                    now_str = datetime.datetime.now().strftime("%H:%M:%S")
                    return True, f"Capture OK: Timber #{number:02d} updated at {now_str}", target_json

            return False, "Capture timeout: Camera script did not respond in time.", ""
        except Exception as e:
            return False, f"File trigger error: {e}", ""

    return False, "Camera script is NOT running! Please start '03_timber_measurement_handdraw_yolo.py' in a terminal.", ""


def resolve_single_json_file(raw_input):
    """
    Resolve the single JSON file to load.
    Timber #00 (timber_00_measurement.json) is strictly reserved for Grasshopper.
    """
    cap_dir = find_default_capture_dir()

    # If the user explicitly provided a path or file
    if raw_input is not None and str(raw_input).strip() != "":
        p_str = str(raw_input).strip().strip('"').strip("'")
        if os.path.isfile(p_str):
            return p_str
        elif os.path.isdir(p_str):
            # Check for timber_00 first in folder
            t00 = os.path.join(p_str, "timber_00_measurement.json")
            if os.path.isfile(t00):
                return t00
            t00_sub = os.path.join(p_str, "captures", "timber_00_measurement.json")
            if os.path.isfile(t00_sub):
                return t00_sub
            # Latest json in directory
            jsons = glob.glob(os.path.join(p_str, "*.json"))
            if jsons:
                jsons.sort(key=os.path.getmtime, reverse=True)
                return jsons[0]

    # Default: look for the reserved timber_00_measurement.json
    if cap_dir:
        t00 = os.path.join(cap_dir, "timber_00_measurement.json")
        if os.path.isfile(t00):
            return t00
        t00_sub = os.path.join(cap_dir, "captures", "timber_00_measurement.json")
        if os.path.isfile(t00_sub):
            return t00_sub

        # If timber_00 not created yet, check if any timber measurement exists as preview
        found = glob.glob(os.path.join(cap_dir, "timber_*_measurement.json"))
        if not found and os.path.isdir(os.path.join(cap_dir, "captures")):
            found = glob.glob(os.path.join(cap_dir, "captures", "timber_*_measurement.json"))
        if found:
            found.sort(key=natural_sort_key)
            return found[0]

    return None


def parse_single_timber(data, file_path):
    """Extract geometry and properties from a single timber JSON dictionary."""
    t_id = data.get("timber_id", data.get("capture_id", 0))
    l_mm = float(data.get("length_mm", 0.0))
    w_mm = float(data.get("width_mm", 0.0))
    th_mm = float(data.get("timber_thickness_mm", data.get("thickness_mm", 0.0)))
    sides = [float(s) for s in data.get("side_lengths_mm", [])]

    if "surface_area_cm2" in data:
        area_cm2 = float(data["surface_area_cm2"])
    elif "surface_area_mm2" in data:
        area_cm2 = float(data["surface_area_mm2"]) / 100.0
    else:
        area_cm2 = (l_mm * w_mm) / 100.0

    # Color
    color_dict = data.get("color_rgb", {})
    r = int(color_dict.get("R", 200))
    g = int(color_dict.get("G", 160))
    b = int(color_dict.get("B", 120))
    c_hex = data.get("color_hex", f"#{r:02x}{g:02x}{b:02x}")
    c_rgb = sd.Color.FromArgb(r, g, b) if sd is not None else (r, g, b)

    # Hand-drawn YOLO shapes
    drawing_crvs = []
    drawing_centers_pts = []
    drawing_cls_names = []
    drawing_conf_vals = []
    drawing_sizes = []

    raw_drawings = data.get("hand_drawn_shapes", [])
    for drw in raw_drawings:
        c_name = drw.get("class_name", "unknown")
        conf = float(drw.get("confidence", 0.0))
        c_mm = drw.get("center_mm", [0.0, 0.0])
        corners_mm = drw.get("bbox_corners_mm", [])

        # Dimensions
        w_d_mm = 0.0
        h_d_mm = 0.0
        if len(corners_mm) >= 4:
            dx1 = corners_mm[1][0] - corners_mm[0][0]
            dy1 = corners_mm[1][1] - corners_mm[0][1]
            w_d_mm = (dx1**2 + dy1**2)**0.5
            dx2 = corners_mm[2][0] - corners_mm[1][0]
            dy2 = corners_mm[2][1] - corners_mm[1][1]
            h_d_mm = (dx2**2 + dy2**2)**0.5

        shape_pts_mm = drw.get("shape_points_mm") or drw.get("bbox_corners_mm", [])

        if IN_RHINO and rg is not None:
            drawing_centers_pts.append(rg.Point3d(float(c_mm[0]), float(c_mm[1]), 0.0))
            if len(shape_pts_mm) >= 3:
                d_pts = [rg.Point3d(float(p[0]), float(p[1]), 0.0) for p in shape_pts_mm]
                d_pts.append(d_pts[0])  # close polyline
                drawing_crvs.append(rg.Polyline(d_pts).ToPolylineCurve())
            else:
                drawing_crvs.append(None)
        else:
            drawing_centers_pts.append(c_mm)
            drawing_crvs.append(shape_pts_mm)

        dim_info = drw.get("dimensions_mm", {})
        size_str = dim_info.get("size_str", f"{w_d_mm:.1f}x{h_d_mm:.1f}mm")

        drawing_cls_names.append(c_name)
        drawing_conf_vals.append(conf)
        drawing_sizes.append(size_str)

    # Geometry
    contour_crv = None
    corners_pts = []
    defect_pts = []
    holes_crvs = []

    raw_holes = data.get("holes_mm", data.get("inner_contours_mm", []))

    if IN_RHINO and rg is not None:
        raw_contour = data.get("contour_mm", data.get("corners_mm", []))
        if raw_contour and len(raw_contour) >= 3:
            pts = [rg.Point3d(float(p[0]), float(p[1]), 0.0) for p in raw_contour]
            pts.append(pts[0])  # close polyline
            contour_crv = rg.Polyline(pts).ToPolylineCurve()

        for h_pts_coords in raw_holes:
            if h_pts_coords and len(h_pts_coords) >= 3:
                h_pts = [rg.Point3d(float(p[0]), float(p[1]), 0.0) for p in h_pts_coords]
                h_pts.append(h_pts[0])
                holes_crvs.append(rg.Polyline(h_pts).ToPolylineCurve())

        for c_pt in data.get("corners_mm", []):
            if len(c_pt) >= 2:
                corners_pts.append(rg.Point3d(float(c_pt[0]), float(c_pt[1]), 0.0))

        for d in data.get("defects", []):
            if isinstance(d, dict):
                dx = float(d.get("center_mm", [0, 0])[0])
                dy = float(d.get("center_mm", [0, 0])[1])
                defect_pts.append(rg.Point3d(dx, dy, 0.0))
            elif isinstance(d, (list, tuple)) and len(d) >= 2:
                defect_pts.append(rg.Point3d(float(d[0]), float(d[1]), 0.0))
    else:
        raw_contour = data.get("contour_mm", data.get("corners_mm", []))
        if raw_contour and len(raw_contour) >= 3:
            contour_crv = raw_contour
        holes_crvs = raw_holes
        corners_pts = data.get("corners_mm", [])
        defect_pts = data.get("defects", [])

    return {
        "timber_id": t_id,
        "length_mm": l_mm,
        "width_mm": w_mm,
        "thickness_mm": th_mm,
        "surface_area_cm2": area_cm2,
        "side_lengths_mm": sides,
        "color_rgb": c_rgb,
        "color_hex": c_hex,
        "contour": contour_crv,
        "holes": holes_crvs,
        "hole_count": len(holes_crvs),
        "corners": corners_pts,
        "defects": defect_pts,
        "drawing_curves": drawing_crvs,
        "drawing_centers": drawing_centers_pts,
        "drawing_classes": drawing_cls_names,
        "drawing_confidences": drawing_conf_vals,
        "drawing_sizes": drawing_sizes,
        "raw": data,
        "file": file_path
    }


# ============================================================
# MAIN COMPONENT EXECUTION
# ============================================================

# 1. Resolve Button Input for Capture
capture_btn = globals().get("capture", None)
if capture_btn is None:
    capture_btn = globals().get("btn_capture", None)
if capture_btn is None:
    capture_btn = globals().get("capture_button", None)
if capture_btn is None:
    capture_btn = globals().get("button", None)
if capture_btn is None:
    capture_btn = globals().get("trigger", None)
if capture_btn is None:
    capture_btn = globals().get("refresh", None)

btn_pressed = False
if capture_btn is not None:
    if isinstance(capture_btn, bool):
        btn_pressed = capture_btn
    elif isinstance(capture_btn, (int, float)):
        btn_pressed = bool(capture_btn)
    elif isinstance(capture_btn, str):
        btn_pressed = capture_btn.strip().lower() in ("true", "1", "yes", "capture")

# Remote server host/port
remote_host = str(globals().get("host", "127.0.0.1")).strip().strip('"').strip("'")
remote_port = int(globals().get("port", 9998))

status_messages = []

# 2. Trigger Capture if Button Pressed
if btn_pressed:
    # Capture timber #00 (reserved for Grasshopper)
    cap_ok, cap_msg, cap_json = trigger_remote_capture(host=remote_host, port=remote_port, number=0)
    status_messages.append(cap_msg)
    if not cap_ok:
        # Give immediate warning in Grasshopper
        print(f"[CAPTURE WARNING] {cap_msg}")

# 3. Resolve Single Target JSON
raw_input = globals().get("json_path", None)
if raw_input is None:
    raw_input = globals().get("json_paths", None)
if raw_input is None:
    raw_input = globals().get("folder", None)
if raw_input is None:
    raw_input = globals().get("path", None)
if raw_input is None:
    raw_input = globals().get("file", None)
if raw_input is None:
    raw_input = globals().get("json", None)

single_json_path = resolve_single_json_file(raw_input)

# 4. Parse the Single JSON
parsed_timber = None
root_data = None

if single_json_path and os.path.exists(single_json_path):
    try:
        with open(single_json_path, "r", encoding="utf-8") as f:
            root_data = json.load(f)
            root_data["_file_path"] = single_json_path

            # If JSON contains a list of timbers, pick selected index or timber #0
            if "timbers" in root_data and isinstance(root_data["timbers"], list) and len(root_data["timbers"]) > 0:
                timber_list = root_data["timbers"]
                sel_idx = globals().get("index", globals().get("selected_index", 0))
                try:
                    t_idx = int(sel_idx) if sel_idx is not None else 0
                    if t_idx < 0 or t_idx >= len(timber_list):
                        t_idx = 0
                except Exception:
                    t_idx = 0
                t_data = timber_list[t_idx]
            else:
                t_data = root_data

            # Inherit markers / reference frame if needed
            if "markers_world_mm" in root_data and "markers_world_mm" not in t_data:
                t_data["markers_world_mm"] = root_data["markers_world_mm"]

            parsed_timber = parse_single_timber(t_data, single_json_path)
    except Exception as exc:
        status_messages.append(f"Error parsing JSON: {exc}")

# 5. Table & Markers Geometry
table_boundary = None
markers_corners_list = []

if IN_RHINO and rg is not None:
    if root_data and "markers_world_mm" in root_data:
        for m_id, m_info in root_data["markers_world_mm"].items():
            if "corners_mm" in m_info and len(m_info["corners_mm"]) == 4:
                m_pts = [rg.Point3d(float(p[0]), float(p[1]), 0.0) for p in m_info["corners_mm"]]
                m_pts.append(m_pts[0])
                markers_corners_list.append(rg.Polyline(m_pts).ToPolylineCurve())

    # Physical Table Rectangle (0,0 to 1780,1040)
    table_pts = [
        rg.Point3d(0.0, 0.0, 0.0),
        rg.Point3d(1780.0, 0.0, 0.0),
        rg.Point3d(1780.0, 1040.0, 0.0),
        rg.Point3d(0.0, 1040.0, 0.0),
        rg.Point3d(0.0, 0.0, 0.0)
    ]
    table_boundary = rg.Polyline(table_pts).ToPolylineCurve()

# 6. Populate Output Variables (Grafted Tree {0} for full Grasshopper compatibility)
if parsed_timber is not None:
    timber_contour = timber_contours = make_grafted_tree([parsed_timber["contour"]])
    timber_holes = inner_cuts = holes = make_grafted_tree([parsed_timber["holes"]])
    timber_corners = corners = make_grafted_tree([parsed_timber["corners"]])
    timber_id = timber_ids = make_grafted_tree([parsed_timber["timber_id"]])
    length_mm = lengths_mm = make_grafted_tree([parsed_timber["length_mm"]])
    width_mm = widths_mm = make_grafted_tree([parsed_timber["width_mm"]])
    thickness_mm = thicknesses_mm = make_grafted_tree([parsed_timber["thickness_mm"]])
    surface_area_cm2 = surface_areas_cm2 = make_grafted_tree([parsed_timber["surface_area_cm2"]])
    side_lengths_mm = make_grafted_tree([parsed_timber["side_lengths_mm"]])
    color_rgb = colors_rgb = make_grafted_tree([parsed_timber["color_rgb"]])
    color_hex = colors_hex = make_grafted_tree([parsed_timber["color_hex"]])
    defects = make_grafted_tree([parsed_timber["defects"]])
    drawing_curves = hand_drawn_shapes = make_grafted_tree([parsed_timber["drawing_curves"]])
    drawing_centers = make_grafted_tree([parsed_timber["drawing_centers"]])
    drawing_classes = make_grafted_tree([parsed_timber["drawing_classes"]])
    drawing_sizes = make_grafted_tree([parsed_timber["drawing_sizes"]])
    drawing_confidences = make_grafted_tree([parsed_timber["drawing_confidences"]])
    file_path = file_paths = make_grafted_tree([single_json_path])
    raw_data = make_grafted_tree([parsed_timber["raw"]])
    markers_corners = make_grafted_tree(markers_corners_list)

    fname = os.path.basename(single_json_path)
    drw_cls = parsed_timber["drawing_classes"]
    drw_str = f" | Drawings: {', '.join(drw_cls)}" if drw_cls else ""
    info = (
        f"Timber #{parsed_timber['timber_id']}: {parsed_timber['length_mm']:.1f} x {parsed_timber['width_mm']:.1f} mm, "
        f"T={parsed_timber['thickness_mm']:.1f}mm{drw_str}\n"
        f"File: {fname}"
    )
    if not status_messages:
        status_messages.append(f"READY: Loaded {fname} (Timber #{parsed_timber['timber_id']})")
else:
    timber_contour = timber_contours = make_grafted_tree([])
    timber_holes = inner_cuts = holes = make_grafted_tree([])
    timber_corners = corners = make_grafted_tree([])
    timber_id = timber_ids = make_grafted_tree([])
    length_mm = lengths_mm = make_grafted_tree([])
    width_mm = widths_mm = make_grafted_tree([])
    thickness_mm = thicknesses_mm = make_grafted_tree([])
    surface_area_cm2 = surface_areas_cm2 = make_grafted_tree([])
    side_lengths_mm = make_grafted_tree([])
    color_rgb = colors_rgb = make_grafted_tree([])
    color_hex = colors_hex = make_grafted_tree([])
    defects = make_grafted_tree([])
    drawing_curves = hand_drawn_shapes = make_grafted_tree([])
    drawing_centers = make_grafted_tree([])
    drawing_classes = make_grafted_tree([])
    drawing_sizes = make_grafted_tree([])
    drawing_confidences = make_grafted_tree([])
    file_path = file_paths = make_grafted_tree([])
    raw_data = make_grafted_tree([])
    markers_corners = make_grafted_tree(markers_corners_list)

    info = "Ready to capture. Connect a Button to 'capture' input and press to capture Timber #00 from live camera."
    if not status_messages:
        status_messages.append("WAITING: Press Button to capture Timber #00 from 03_timber_measurement_handdraw_yolo.py")

status = " | ".join(status_messages)
# ---------- end timber_reader ----------
timber_reader_2 = Python3Script(json_path=path_2, refresh=button_2, index=number_slider)  # -> out, timber_id, timber_contour, timber_corners, timber_holes, length_mm, width_mm, thickness_mm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; inputs json_path: String, refresh: Boolean; disabled
# ---------- timber_reader_2: Python ----------
"""
================================================================================
eWoodX - Grasshopper GhPython Component: Single-Timber Reader & Live Capture
================================================================================

Description:
  Reads timber geometry, dimensions, and hand-drawn YOLO annotations from JSON.
  Features a live Button input to remotely trigger capture and measurement
  in 03_timber_measurement_handdraw_yolo.py.

  Timber Number 0 is strictly reserved for Grasshopper captures:
    - Capturing from Grasshopper updates 'timber_00_measurement.json' & 'timber_00.jpg'.
    - Does NOT alter the manual camera counter (timbers 1, 2, 3... remain intact).
    - Designed specifically to work with this single JSON.

How to use in Grasshopper:
1. Place a "GhPython Script" component on the Grasshopper canvas.
2. Configure Component Inputs:
     - capture    : (Item/List Access, Type Hint: bool) [Button: press to capture live frame]
                    (Also supports names: refresh, btn_capture, button, trigger)
     - json_path  : (Item Access, Type Hint: str, Optional)
                    [Folder or single JSON. Leave empty to automatically use reserved timber_00_measurement.json]
     - index      : (Item Access, Type Hint: int, Optional)
                    [Index of timber if file has multiple, default: 0]
     - host       : (Item Access, Type Hint: str, Optional) [Default: 127.0.0.1]
     - port       : (Item Access, Type Hint: int, Optional) [Default: 9998]

3. Configure Component Outputs (Grafted DataTree {0} per timber for full compatibility):
     - timber_contour  : PolylineCurve outline of the timber
     - timber_corners  : 4 Point3d corner points
     - timber_holes    : Inner cutout / hole curves
     - timber_id       : Timber ID (0 for Grasshopper captures)
     - length_mm       : Calibrated length (mm)
     - width_mm        : Calibrated width (mm)
     - thickness_mm    : Timber thickness (mm)
     - surface_area_cm2: Surface area (cm²)
     - side_lengths_mm : Length of 4 sides (mm)
     - color_rgb       : System.Drawing.Color / RGB
     - color_hex       : Hex color string (#rrggbb)
     - defects         : List of defect Point3d
     - drawing_curves  : Hand-drawn shape curves (ellipse, rect, triangle)
     - drawing_centers : Center Point3d of hand-drawn shapes
     - drawing_classes : Class names of shapes ('ellipse', 'rectangle', 'triangle')
     - drawing_sizes   : Dimension string of shapes (e.g. '120.5x80.2mm')
     - drawing_confidences: YOLO detection confidence scores (0.0 - 1.0)
     - table_boundary  : PolylineCurve of physical table workspace
     - markers_corners : ArUco marker boundary curves
     - file_path       : Path to the loaded JSON file
     - status          : Live capture status & connection diagnostics
     - info            : Formatted summary text

4. Paste this entire code into the GhPython component editor.
================================================================================
"""

import os
import glob
import json
import re
import socket
import time
import datetime

# Rhino, Grasshopper & .NET imports with safe fallback for testing outside Rhino
try:
    import Rhino.Geometry as rg
    import System.Drawing as sd
    import Grasshopper
    from Grasshopper.Kernel.Data import GH_Path
    from Grasshopper import DataTree
    IN_RHINO = True
    HAS_DATATREE = True
except ImportError:
    rg = None
    sd = None
    DataTree = None
    GH_Path = None
    IN_RHINO = False
    HAS_DATATREE = False


# ============================================================
# DATATREE & VALUE EXTRACTION HELPERS
# ============================================================

def make_grafted_tree(items_per_timber):
    """
    Convert a list of items (where item i belongs to timber i)
    into a Grasshopper DataTree with branch paths {0}, {1}...
    """
    if not HAS_DATATREE or DataTree is None:
        return items_per_timber

    tree = DataTree[object]()
    for i, val in enumerate(items_per_timber):
        path = GH_Path(i)
        if isinstance(val, (list, tuple)):
            for sub_val in val:
                tree.Add(sub_val, path)
        elif val is not None:
            tree.Add(val, path)
    return tree


def extract_bool(val):
    """
    Safely extract boolean state from any GH_Boolean, System.Boolean,
    list, DataTree, or primitive. Essential for Grasshopper Button components.
    """
    if val is None:
        return False
    # GH_Boolean or wrapped Goo with .Value property
    if hasattr(val, "Value"):
        try:
            return bool(val.Value)
        except Exception:
            pass
    # DataTree with .AllData()
    if hasattr(val, "AllData"):
        try:
            for item in val.AllData():
                if extract_bool(item):
                    return True
        except Exception:
            pass
        return False
    # Python list or tuple
    if isinstance(val, (list, tuple)):
        for item in val:
            if extract_bool(item):
                return True
        return False
    # .NET collection / IEnumerable (e.g. List[Boolean])
    if hasattr(val, "__iter__") and not isinstance(val, (str, bytes)):
        try:
            for item in val:
                if extract_bool(item):
                    return True
        except Exception:
            pass
        return False
    # Standard Python bool
    if isinstance(val, bool):
        return val
    # Numeric
    if isinstance(val, (int, float)):
        return bool(val)
    # String representation
    if isinstance(val, str):
        return val.strip().lower() in ("true", "1", "yes", "capture", "pressed")
    try:
        s = str(val).strip().lower()
        if s in ("true", "1", "yes"):
            return True
    except Exception:
        pass
    return False


def extract_single_string(val):
    """Safely extract a single string from any DataTree, list, or primitive."""
    if val is None:
        return None
    if hasattr(val, "Value"):
        try:
            return str(val.Value).strip()
        except Exception:
            pass
    if hasattr(val, "AllData"):
        try:
            for item in val.AllData():
                s = extract_single_string(item)
                if s:
                    return s
        except Exception:
            pass
        return None
    if isinstance(val, (list, tuple)):
        for item in val:
            s = extract_single_string(item)
            if s:
                return s
        return None
    if hasattr(val, "__iter__") and not isinstance(val, (str, bytes)):
        try:
            for item in val:
                s = extract_single_string(item)
                if s:
                    return s
        except Exception:
            pass
        return None
    s_val = str(val).strip().strip('"').strip("'")
    return s_val if s_val else None


def find_default_capture_dir():
    """Locate the captures folder across common workspace directories."""
    search_dirs = [
        r"C:\Users\hamid\Documents\GitHub\eWoodX\Webcam detection\sample_output\captures",
        r"C:\Users\hamid\Documents\GitHub\eWoodX\Webcam detection\sample_output",
        os.path.expanduser(r"~\Documents\GitHub\eWoodX\Webcam detection\sample_output\captures"),
        os.path.expanduser(r"~\Documents\GitHub\eWoodX\sample_output\captures"),
        os.path.expanduser(r"~\Documents\GitHub\eWoodX\sample_output"),
        os.path.join(os.path.dirname(os.path.abspath(__file__)), "sample_output", "captures") if "__file__" in globals() and __file__ else "",
        r".\sample_output\captures",
        r".\captures"
    ]
    for s_dir in search_dirs:
        if s_dir and os.path.isdir(s_dir):
            return os.path.normpath(s_dir)
    return None


def natural_sort_key(s):
    """Sort strings with numbers naturally (timber_1, timber_2, ..., timber_10)."""
    return [int(text) if text.isdigit() else text.lower() for text in re.split(r'(\d+)', s)]


# ============================================================
# REMOTE CAPTURE TRIGGER
# ============================================================

def trigger_remote_capture(host="127.0.0.1", port=9998, number=0, timeout=15.0):
    """
    Remotely signal 03_timber_measurement_handdraw_yolo.py to capture and measure.
    Uses TCP socket first (port 9998). If socket fails, uses capture_trigger.json fallback.
    Returns (success: bool, status_msg: str, json_path: str)
    """
    # 1. Primary Method: TCP Socket
    try:
        sock = socket.socket(socket.AF_INET, socket.SOCK_STREAM)
        sock.settimeout(timeout)
        sock.connect((host, int(port)))
        payload = json.dumps({"action": "capture", "number": int(number)}) + "\n"
        sock.sendall(payload.encode("utf-8"))

        raw_resp = sock.recv(4096)
        sock.close()

        if raw_resp:
            resp_str = raw_resp.decode("utf-8", errors="ignore").strip()
            data = json.loads(resp_str)
            if data.get("status") == "success":
                now_str = datetime.datetime.now().strftime("%H:%M:%S")
                j_path = data.get("json_path", "")
                return True, f"Capture OK: Timber #{number:02d} captured and saved at {now_str}", j_path
            else:
                return False, f"Capture error from camera script: {data.get('message', 'Unknown error')}", ""
    except Exception as e:
        # Socket failed, fall through to file trigger
        pass

    # 2. Fallback Method: File-based trigger
    cap_dir = find_default_capture_dir()
    if cap_dir and os.path.isdir(cap_dir):
        trig_file = os.path.join(cap_dir, "capture_trigger.json")
        status_file = os.path.join(cap_dir, "capture_status.json")
        target_json = os.path.join(cap_dir, f"timber_{number:02d}_measurement.json")
        start_time = time.time()
        prev_mtime = os.path.getmtime(target_json) if os.path.exists(target_json) else 0

        try:
            with open(trig_file, "w", encoding="utf-8") as tf:
                json.dump({"action": "capture", "number": int(number), "time": start_time}, tf)

            while (time.time() - start_time) < timeout:
                time.sleep(0.15)
                if os.path.exists(status_file):
                    try:
                        with open(status_file, "r", encoding="utf-8") as sf:
                            sdata = json.load(sf)
                        os.remove(status_file)
                        if sdata.get("status") == "success":
                            now_str = datetime.datetime.now().strftime("%H:%M:%S")
                            return True, f"Capture OK: Timber #{number:02d} updated via file trigger at {now_str}", target_json
                    except Exception:
                        pass

                if os.path.exists(target_json) and os.path.getmtime(target_json) > prev_mtime:
                    now_str = datetime.datetime.now().strftime("%H:%M:%S")
                    return True, f"Capture OK: Timber #{number:02d} updated at {now_str}", target_json

            return False, "Capture timeout: Camera script did not respond in time.", ""
        except Exception as e:
            return False, f"File trigger error: {e}", ""

    return False, "Camera script is NOT running! Please run '03_timber_measurement_handdraw_yolo.py' in a terminal.", ""


def resolve_single_json_file(raw_input):
    """
    Resolve the single JSON file to load.
    Prioritizes reserved timber #00 (timber_00_measurement.json).
    If timber_00 does not exist yet, falls back to the most recent measurement JSON.
    """
    clean_path = extract_single_string(raw_input)
    cap_dir = None

    if clean_path:
        clean_path = os.path.normpath(clean_path)
        if os.path.isfile(clean_path):
            return clean_path
        elif os.path.isdir(clean_path):
            cap_dir = clean_path

    if not cap_dir:
        cap_dir = find_default_capture_dir()

    if cap_dir and os.path.isdir(cap_dir):
        # 1. Target reserved timber_00_measurement.json
        t00 = os.path.join(cap_dir, "timber_00_measurement.json")
        if os.path.isfile(t00):
            return t00
        t00_sub = os.path.join(cap_dir, "captures", "timber_00_measurement.json")
        if os.path.isfile(t00_sub):
            return t00_sub

        # 2. If timber_00 not created yet, preview the latest available capture
        all_measurements = glob.glob(os.path.join(cap_dir, "timber_*_measurement.json"))
        if not all_measurements and os.path.isdir(os.path.join(cap_dir, "captures")):
            all_measurements = glob.glob(os.path.join(cap_dir, "captures", "timber_*_measurement.json"))
        if not all_measurements:
            all_measurements = glob.glob(os.path.join(cap_dir, "*.json"))

        if all_measurements:
            # Sort naturally so highest number (latest) is picked
            all_measurements.sort(key=natural_sort_key)
            return all_measurements[-1]

    return None


def parse_single_timber(data, file_path):
    """Extract geometry and properties from a single timber JSON dictionary."""
    t_id = data.get("timber_id", data.get("capture_id", 0))
    l_mm = float(data.get("length_mm", 0.0))
    w_mm = float(data.get("width_mm", 0.0))
    th_mm = float(data.get("timber_thickness_mm", data.get("thickness_mm", 0.0)))
    sides = [float(s) for s in data.get("side_lengths_mm", [])]

    if "surface_area_cm2" in data:
        area_cm2 = float(data["surface_area_cm2"])
    elif "surface_area_mm2" in data:
        area_cm2 = float(data["surface_area_mm2"]) / 100.0
    else:
        area_cm2 = (l_mm * w_mm) / 100.0

    # Color
    color_dict = data.get("color_rgb", {})
    r = int(color_dict.get("R", 200))
    g = int(color_dict.get("G", 160))
    b = int(color_dict.get("B", 120))
    c_hex = data.get("color_hex", f"#{r:02x}{g:02x}{b:02x}")
    c_rgb = sd.Color.FromArgb(r, g, b) if sd is not None else (r, g, b)

    # Hand-drawn YOLO shapes
    drawing_crvs = []
    drawing_centers_pts = []
    drawing_cls_names = []
    drawing_conf_vals = []
    drawing_sizes = []

    raw_drawings = data.get("hand_drawn_shapes", [])
    for drw in raw_drawings:
        c_name = drw.get("class_name", "unknown")
        conf = float(drw.get("confidence", 0.0))
        c_mm = drw.get("center_mm", [0.0, 0.0])
        corners_mm = drw.get("bbox_corners_mm", [])

        # Dimensions
        w_d_mm = 0.0
        h_d_mm = 0.0
        if len(corners_mm) >= 4:
            dx1 = corners_mm[1][0] - corners_mm[0][0]
            dy1 = corners_mm[1][1] - corners_mm[0][1]
            w_d_mm = (dx1**2 + dy1**2)**0.5
            dx2 = corners_mm[2][0] - corners_mm[1][0]
            dy2 = corners_mm[2][1] - corners_mm[1][1]
            h_d_mm = (dx2**2 + dy2**2)**0.5

        shape_pts_mm = drw.get("shape_points_mm") or drw.get("bbox_corners_mm", [])

        if IN_RHINO and rg is not None:
            drawing_centers_pts.append(rg.Point3d(float(c_mm[0]), float(c_mm[1]), 0.0))
            if len(shape_pts_mm) >= 3:
                d_pts = [rg.Point3d(float(p[0]), float(p[1]), 0.0) for p in shape_pts_mm]
                d_pts.append(d_pts[0])  # close polyline
                drawing_crvs.append(rg.Polyline(d_pts).ToPolylineCurve())
            else:
                drawing_crvs.append(None)
        else:
            drawing_centers_pts.append(c_mm)
            drawing_crvs.append(shape_pts_mm)

        dim_info = drw.get("dimensions_mm", {})
        size_str = dim_info.get("size_str", f"{w_d_mm:.1f}x{h_d_mm:.1f}mm")

        drawing_cls_names.append(c_name)
        drawing_conf_vals.append(conf)
        drawing_sizes.append(size_str)

    # Geometry
    contour_crv = None
    corners_pts = []
    defect_pts = []
    holes_crvs = []

    raw_holes = data.get("holes_mm", data.get("inner_contours_mm", []))

    if IN_RHINO and rg is not None:
        raw_contour = data.get("contour_mm", data.get("corners_mm", []))
        if raw_contour and len(raw_contour) >= 3:
            pts = [rg.Point3d(float(p[0]), float(p[1]), 0.0) for p in raw_contour]
            pts.append(pts[0])  # close polyline
            contour_crv = rg.Polyline(pts).ToPolylineCurve()

        for h_pts_coords in raw_holes:
            if h_pts_coords and len(h_pts_coords) >= 3:
                h_pts = [rg.Point3d(float(p[0]), float(p[1]), 0.0) for p in h_pts_coords]
                h_pts.append(h_pts[0])
                holes_crvs.append(rg.Polyline(h_pts).ToPolylineCurve())

        for c_pt in data.get("corners_mm", []):
            if len(c_pt) >= 2:
                corners_pts.append(rg.Point3d(float(c_pt[0]), float(c_pt[1]), 0.0))

        for d in data.get("defects", []):
            if isinstance(d, dict):
                dx = float(d.get("center_mm", [0, 0])[0])
                dy = float(d.get("center_mm", [0, 0])[1])
                defect_pts.append(rg.Point3d(dx, dy, 0.0))
            elif isinstance(d, (list, tuple)) and len(d) >= 2:
                defect_pts.append(rg.Point3d(float(d[0]), float(d[1]), 0.0))
    else:
        raw_contour = data.get("contour_mm", data.get("corners_mm", []))
        if raw_contour and len(raw_contour) >= 3:
            contour_crv = raw_contour
        holes_crvs = raw_holes
        corners_pts = data.get("corners_mm", [])
        defect_pts = data.get("defects", [])

    return {
        "timber_id": t_id,
        "length_mm": l_mm,
        "width_mm": w_mm,
        "thickness_mm": th_mm,
        "surface_area_cm2": area_cm2,
        "side_lengths_mm": sides,
        "color_rgb": c_rgb,
        "color_hex": c_hex,
        "contour": contour_crv,
        "holes": holes_crvs,
        "hole_count": len(holes_crvs),
        "corners": corners_pts,
        "defects": defect_pts,
        "drawing_curves": drawing_crvs,
        "drawing_centers": drawing_centers_pts,
        "drawing_classes": drawing_cls_names,
        "drawing_confidences": drawing_conf_vals,
        "drawing_sizes": drawing_sizes,
        "raw": data,
        "file": file_path
    }


# ============================================================
# MAIN COMPONENT EXECUTION
# ============================================================

# 1. Detect Button Press (Supports any input name: capture, refresh, btn_capture, button, trigger)
btn_pressed = False
btn_name_found = None
for candidate in ["capture", "refresh", "btn_capture", "capture_button", "button", "trigger", "btn"]:
    if candidate in globals() and globals()[candidate] is not None:
        raw_val = globals()[candidate]
        if extract_bool(raw_val):
            btn_pressed = True
            btn_name_found = candidate
            break

# Remote server host/port
remote_host = str(extract_single_string(globals().get("host", "127.0.0.1")) or "127.0.0.1")
try:
    remote_port = int(globals().get("port", 9998))
except Exception:
    remote_port = 9998

status_messages = []
captured_file_path = None

# 2. Trigger Capture if Button Pressed
if btn_pressed:
    print(f"[GhTimberReader] Button '{btn_name_found}' pressed! Requesting capture from camera ({remote_host}:{remote_port})...")
    cap_ok, cap_msg, cap_json = trigger_remote_capture(host=remote_host, port=remote_port, number=0, timeout=15.0)
    print(f"[GhTimberReader] {cap_msg}")
    status_messages.append(cap_msg)
    if cap_ok and cap_json and os.path.isfile(cap_json):
        captured_file_path = cap_json

# 3. Resolve Target Single JSON
if captured_file_path:
    single_json_path = captured_file_path
else:
    # Resolve from input or default
    raw_path_input = None
    for p_name in ["json_path", "json_paths", "folder", "path", "file", "json"]:
        if p_name in globals() and globals()[p_name] is not None:
            raw_path_input = globals()[p_name]
            break
    single_json_path = resolve_single_json_file(raw_path_input)

# 4. Parse the Single JSON
parsed_timber = None
root_data = None

if single_json_path and os.path.exists(single_json_path):
    try:
        with open(single_json_path, "r", encoding="utf-8") as f:
            root_data = json.load(f)
            root_data["_file_path"] = single_json_path

            # If JSON contains a list of timbers, pick selected index or timber #0
            if "timbers" in root_data and isinstance(root_data["timbers"], list) and len(root_data["timbers"]) > 0:
                timber_list = root_data["timbers"]
                sel_idx = globals().get("index", globals().get("selected_index", 0))
                try:
                    t_idx = int(sel_idx) if sel_idx is not None else 0
                    if t_idx < 0 or t_idx >= len(timber_list):
                        t_idx = 0
                except Exception:
                    t_idx = 0
                t_data = timber_list[t_idx]
            else:
                t_data = root_data

            # Inherit markers / reference frame if needed
            if "markers_world_mm" in root_data and "markers_world_mm" not in t_data:
                t_data["markers_world_mm"] = root_data["markers_world_mm"]

            parsed_timber = parse_single_timber(t_data, single_json_path)
    except Exception as exc:
        err_msg = f"Error parsing JSON ({os.path.basename(single_json_path)}): {exc}"
        print(f"[GhTimberReader] {err_msg}")
        status_messages.append(err_msg)

# 5. Table & Markers Geometry
table_boundary = None
markers_corners_list = []

if IN_RHINO and rg is not None:
    if root_data and "markers_world_mm" in root_data:
        for m_id, m_info in root_data["markers_world_mm"].items():
            if "corners_mm" in m_info and len(m_info["corners_mm"]) == 4:
                m_pts = [rg.Point3d(float(p[0]), float(p[1]), 0.0) for p in m_info["corners_mm"]]
                m_pts.append(m_pts[0])
                markers_corners_list.append(rg.Polyline(m_pts).ToPolylineCurve())

    # Physical Table Rectangle (0,0 to 1780,1040)
    table_pts = [
        rg.Point3d(0.0, 0.0, 0.0),
        rg.Point3d(1780.0, 0.0, 0.0),
        rg.Point3d(1780.0, 1040.0, 0.0),
        rg.Point3d(0.0, 1040.0, 0.0),
        rg.Point3d(0.0, 0.0, 0.0)
    ]
    table_boundary = rg.Polyline(table_pts).ToPolylineCurve()

# 6. Populate Output Variables (Grafted Tree {0} for full Grasshopper compatibility)
if parsed_timber is not None:
    timber_contour = timber_contours = make_grafted_tree([parsed_timber["contour"]])
    timber_holes = inner_cuts = holes = make_grafted_tree([parsed_timber["holes"]])
    timber_corners = corners = make_grafted_tree([parsed_timber["corners"]])
    timber_id = timber_ids = make_grafted_tree([parsed_timber["timber_id"]])
    length_mm = lengths_mm = make_grafted_tree([parsed_timber["length_mm"]])
    width_mm = widths_mm = make_grafted_tree([parsed_timber["width_mm"]])
    thickness_mm = thicknesses_mm = make_grafted_tree([parsed_timber["thickness_mm"]])
    surface_area_cm2 = surface_areas_cm2 = make_grafted_tree([parsed_timber["surface_area_cm2"]])
    side_lengths_mm = make_grafted_tree([parsed_timber["side_lengths_mm"]])
    color_rgb = colors_rgb = make_grafted_tree([parsed_timber["color_rgb"]])
    color_hex = colors_hex = make_grafted_tree([parsed_timber["color_hex"]])
    defects = make_grafted_tree([parsed_timber["defects"]])
    drawing_curves = hand_drawn_shapes = make_grafted_tree([parsed_timber["drawing_curves"]])
    drawing_centers = make_grafted_tree([parsed_timber["drawing_centers"]])
    drawing_classes = make_grafted_tree([parsed_timber["drawing_classes"]])
    drawing_sizes = make_grafted_tree([parsed_timber["drawing_sizes"]])
    drawing_confidences = make_grafted_tree([parsed_timber["drawing_confidences"]])
    file_path = file_paths = make_grafted_tree([single_json_path])
    raw_data = make_grafted_tree([parsed_timber["raw"]])
    markers_corners = make_grafted_tree(markers_corners_list)

    fname = os.path.basename(single_json_path)
    drw_cls = parsed_timber["drawing_classes"]
    drw_str = f" | Drawings: {', '.join(drw_cls)}" if drw_cls else ""
    info = (
        f"Timber #{parsed_timber['timber_id']}: {parsed_timber['length_mm']:.1f} x {parsed_timber['width_mm']:.1f} mm, "
        f"T={parsed_timber['thickness_mm']:.1f}mm{drw_str}\n"
        f"File: {fname}"
    )
    if not status_messages:
        status_messages.append(f"READY: Loaded {fname} (Timber #{parsed_timber['timber_id']})")
    
    # Print status summary to Grasshopper 'out' parameter
    print(f"[GhTimberReader] Active File: {fname} (Timber #{parsed_timber['timber_id']}) -> {parsed_timber['length_mm']:.1f} x {parsed_timber['width_mm']:.1f} mm{drw_str}")
else:
    timber_contour = timber_contours = make_grafted_tree([])
    timber_holes = inner_cuts = holes = make_grafted_tree([])
    timber_corners = corners = make_grafted_tree([])
    timber_id = timber_ids = make_grafted_tree([])
    length_mm = lengths_mm = make_grafted_tree([])
    width_mm = widths_mm = make_grafted_tree([])
    thickness_mm = thicknesses_mm = make_grafted_tree([])
    surface_area_cm2 = surface_areas_cm2 = make_grafted_tree([])
    side_lengths_mm = make_grafted_tree([])
    color_rgb = colors_rgb = make_grafted_tree([])
    color_hex = colors_hex = make_grafted_tree([])
    defects = make_grafted_tree([])
    drawing_curves = hand_drawn_shapes = make_grafted_tree([])
    drawing_centers = make_grafted_tree([])
    drawing_classes = make_grafted_tree([])
    drawing_sizes = make_grafted_tree([])
    drawing_confidences = make_grafted_tree([])
    file_path = file_paths = make_grafted_tree([])
    raw_data = make_grafted_tree([])
    markers_corners = make_grafted_tree(markers_corners_list)

    info = "No JSON found. Connect a Button to 'refresh' / 'capture' and press to capture Timber #00 from live camera."
    if not status_messages:
        status_messages.append("WAITING: Press Button to capture Timber #00 from 03_timber_measurement_handdraw_yolo.py")
    print("[GhTimberReader] WAITING: No timber JSON found. Press Button to capture Timber #00 from camera.")

status = " | ".join(status_messages)
# ---------- end timber_reader_2 ----------
panel = Panel(timber_reader.status)
crv = Curve(timber_reader.table_boundary)
panel_2 = Panel(timber_reader_2.color_rgb)  # disabled
explode = Explode(Recursive=True)  # -> Segments, Vertices
panel_3 = Panel(timber_reader.file_path)
crv_2 = Curve(timber_reader.timber_holes)
panel_4 = Panel(timber_reader_2.thickness_mm)  # disabled
crv_3 = Curve(timber_reader_2.table_boundary)  # disabled
crv_4 = Curve(timber_reader_2.drawing_curves)  # disabled
crv_5 = Curve(timber_reader.timber_contour)

# ---- group: Loads (Karamba3D)
gravity = LoadsKaramba3D(Vector=Vector(0, 0, -1), LCase="LC0", mode="Gravity")  # disabled

gravity_2 = LoadsKaramba3D(Vector=Vector(0, 0, -1), LCase="LC0", mode="Gravity")  # disabled

gravity_3 = LoadsKaramba3D(Vector=Vector(0, 0, -1), LCase="LC0", mode="Gravity")  # disabled

# ----
md_slider = MDSlider(
    SliderMode=0,
    slider_value=Point(0.8853893745, 0.1052830394, 0.5),
    x_domain=Domain(0, 1),
    y_domain=Domain(0, 1),
    z_domain=Domain(0, 1))  # disabled
# Live sender
crv_6 = Curve([timber_reader_2.timber_contour, timber_reader_2.timber_holes])
number_slider_2 = Slider(0, range=0..100)
swatch = ColourSwatch(SwatchColor=RGB(255, 0, 0))
swatch_2 = ColourSwatch(SwatchColor=RGB(0, 221, 255))
crv_7 = Curve(timber_reader_2.drawing_curves)  # disabled

# ----
# V1
# Original Stress Line
# Simplify Stress Line
number_slider_3 = Slider(1.2, range=0..10)  # disabled
number_slider_4 = Slider(0.75, range=0..1)  # disabled
rectangle = Rectangle(Plane=PlaneXY(0, 0, 0), XSize=number_slider_3, YSize=number_slider_3, Radius=0)  # -> Rectangle, Length; disabled
Z = UnitZ(Factor=number_slider_4)  # disabled
move = Move(Geometry=rectangle.Rectangle, Motion=Z)  # -> Geometry, Transform; disabled
explode_2 = Explode(Curve=move.Geometry, Recursive=True)  # -> Segments, Vertices; disabled
neg = Negative(Value=Z)  # disabled
number_slider_5 = Slider(4, range=0..10)  # disabled
boundary = BoundarySurfaces(Edges=move.Geometry)  # -> reparameterize(Surfaces); disabled
md_slider_2 = MDSlider(
    SliderMode=0,
    slider_value=Point(0.7131049924, 0.4168154088, 0.5),
    x_domain=Domain(0, 1),
    y_domain=Domain(0, 1),
    z_domain=Domain(0, 1))  # disabled
matselect = MaterialSelectionKaramba3D(menu=[dropdown(0), dropdown(2), dropdown(1)])  # disabled
panel_5 = Panel("4")  # disabled
panel_6 = Panel("0.05")  # disabled
panel_7 = Panel("2")  # disabled
trapezoid = CrossSectionKaramba3D(
    FamilyNameOfCrossSection="DefaultCroSec",
    Material=matselect,
    Height_cm=panel_5,
    UpperFlangeWidth_cm=panel_5,
    LowerFlangeWidth_cm=panel_5,
    mode="Trapezoid")  # disabled
shell_const = CrossSectionKaramba3D(FamilyNameOfCrossSection="DefaultCroSec", Material=matselect, Height_cm=panel_7, mode="Shell - Const")  # disabled
relay = Relay()  # disabled
number_slider_6 = Slider(0.08, range=0..0.1)  # disabled
number_slider_7 = Slider(3, range=0..10)  # disabled
number_slider_8 = Slider(0.3, range=0..1)  # disabled
number_slider_9 = Slider(10, range=0..100)  # disabled
number_slider_10 = Slider(1, range=0..10)  # disabled
panel_8 = Panel("0")  # disabled
number_slider_11 = Slider(4, range=0..10)  # disabled
panel_9 = Panel("0.3 TO 0.95")  # disabled
number_slider_12 = Slider(0.5, range=0..1)  # disabled
range = Range(Domain=panel_9, Steps=number_slider_10)  # disabled
number_slider_13 = Slider(3, range=0..10)  # disabled
number_slider_14 = Slider(0.01, range=0..0.1)  # disabled
panel_10 = Panel("{0;0;0;0}")  # disabled
panel_11 = Panel("{0;0;0;1}")  # disabled
panel_12 = Panel("{0;0;1;0}")  # disabled
panel_13 = Panel("{0;0;1;1}")  # disabled
number_slider_15 = Slider(1000, range=0..1000)  # disabled
number_slider_16 = Slider(1000, range=0..1000)  # disabled
number_slider_17 = Slider(23, range=0..100)  # disabled
number_slider_18 = Slider(14, range=0..100)  # disabled
radians = Radians(Degrees=number_slider_17)  # disabled
number_slider_19 = Slider(1, range=1..5)  # disabled
number_slider_20 = Slider(1, range=1..5)  # disabled
vector_star = VectorStar(Plane=PlaneXY(0, 0, 0), Steps=number_slider_19, SubdivisionType=0, Dimensionality=True)  # -> Vectors, Lines; disabled
vector_star_2 = VectorStar(Plane=PlaneXY(0, 0, 0), Steps=number_slider_20, SubdivisionType=0, Dimensionality=True)  # -> Vectors, Lines; disabled
value_list = ValueList({"RTree": 1, "Grid": 2, "Field (could be long)": 0}, selected="RTree")  # disabled
number_slider_21 = Slider(33, range=0..100)  # disabled
number_slider_22 = Slider(0, range=0..1000)  # disabled

# ----
# Original Stress Line
# V2
# Simplify Stress Line
number_slider_23 = Slider(1.2, range=0..10)  # disabled
number_slider_24 = Slider(7.5, range=0..10)  # disabled
number_slider_25 = Slider(0.75, range=0..1)  # disabled
number_slider_26 = Slider(5, range=0..10)  # disabled
rectangle_2 = Rectangle(Plane=PlaneXY(0, 0, 0), XSize=number_slider_23, YSize=number_slider_23, Radius=0)  # -> Rectangle, Length; disabled
Z_2 = UnitZ(Factor=number_slider_25)  # disabled
move_2 = Move(Geometry=rectangle_2.Rectangle, Motion=Z_2)  # -> Geometry, Transform; disabled
neg_2 = Negative(Value=Z_2)  # disabled
md_slider_3 = MDSlider(
    SliderMode=0,
    slider_value=Point(0.8363721894, 0.8205138416, 0.5),
    x_domain=Domain(0, 1),
    y_domain=Domain(0, 1),
    z_domain=Domain(0, 1))  # disabled
md_slider_4 = MDSlider(
    SliderMode=0,
    slider_value=Point(0.4175675555, 0.1098770514, 0.5),
    x_domain=Domain(0, 1),
    y_domain=Domain(0, 1),
    z_domain=Domain(0, 1))  # disabled
number_slider_27 = Slider(20, range=0..20)  # disabled
matselect_2 = MaterialSelectionKaramba3D(menu=[dropdown(0), dropdown(2), dropdown(1)])  # disabled
panel_14 = Panel("4")  # disabled
panel_15 = Panel("0.035")  # disabled
panel_16 = Panel("2")  # disabled
trapezoid_2 = CrossSectionKaramba3D(
    FamilyNameOfCrossSection="DefaultCroSec",
    Material=matselect_2,
    Height_cm=panel_14,
    UpperFlangeWidth_cm=panel_14,
    LowerFlangeWidth_cm=panel_14,
    mode="Trapezoid")  # disabled
shell_const_2 = CrossSectionKaramba3D(FamilyNameOfCrossSection="DefaultCroSec", Material=matselect_2, Height_cm=panel_16, mode="Shell - Const")  # disabled
relay_2 = Relay()  # disabled
number_slider_28 = Slider(0.08, range=0..0.1)  # disabled
number_slider_29 = Slider(3, range=0..10)  # disabled
number_slider_30 = Slider(0.3, range=0..1)  # disabled
number_slider_31 = Slider(20, range=0..40)  # disabled
number_slider_32 = Slider(24, range=0..40)  # disabled
number_slider_33 = Slider(21, range=0..40)  # disabled
number_slider_34 = Slider(25, range=0..40)  # disabled
number_slider_35 = Slider(26, range=0..40)  # disabled
number_slider_36 = Slider(27, range=0..40)  # disabled
number_slider_37 = Slider(30, range=0..40)  # disabled
number_slider_38 = Slider(31, range=0..40)  # disabled
number_slider_39 = Slider(32, range=0..40)  # disabled
number_slider_40 = Slider(33, range=0..40)  # disabled
number_slider_41 = Slider(34, range=0..40)  # disabled
number_slider_42 = Slider(35, range=0..40)  # disabled
number_slider_43 = Slider(10, range=0..100)  # disabled
number_slider_44 = Slider(1, range=0..10)  # disabled
panel_17 = Panel("0")  # disabled
number_slider_45 = Slider(4, range=0..10)  # disabled
panel_18 = Panel("0.3 TO 0.95")  # disabled
number_slider_46 = Slider(0, range=0..40)  # disabled
number_slider_47 = Slider(4, range=0..40)  # disabled
number_slider_48 = Slider(6, range=0..40)  # disabled
number_slider_49 = Slider(14, range=0..40)  # disabled
number_slider_50 = Slider(0.5, range=0..1)  # disabled
number_slider_51 = Slider(1, range=0..40)  # disabled
number_slider_52 = Slider(5, range=0..40)  # disabled
number_slider_53 = Slider(7, range=0..40)  # disabled
number_slider_54 = Slider(15, range=0..40)  # disabled
range_2 = Range(Domain=panel_18, Steps=number_slider_44)  # disabled
number_slider_55 = Slider(1000, range=0..1000)  # disabled
number_slider_56 = Slider(1000, range=0..1000)  # disabled
number_slider_57 = Slider(0, range=0..40)  # disabled
number_slider_58 = Slider(1, range=0..40)  # disabled
number_slider_59 = Slider(2, range=0..40)  # disabled
number_slider_60 = Slider(3, range=0..40)  # disabled
number_slider_61 = Slider(12, range=0..40)  # disabled
number_slider_62 = Slider(4, range=0..40)  # disabled
number_slider_63 = Slider(10, range=0..40)  # disabled
number_slider_64 = Slider(13, range=0..40)  # disabled
number_slider_65 = Slider(5, range=0..40)  # disabled
number_slider_66 = Slider(18, range=0..40)  # disabled
number_slider_67 = Slider(11, range=0..40)  # disabled
number_slider_68 = Slider(19, range=0..40)  # disabled
number_slider_69 = Slider(20, range=0..40)  # disabled
number_slider_70 = Slider(21, range=0..40)  # disabled
number_slider_71 = Slider(30, range=0..40)  # disabled
number_slider_72 = Slider(31, range=0..40)  # disabled
number_slider_73 = Slider(32, range=0..40)  # disabled
number_slider_74 = Slider(33, range=0..40)  # disabled
number_slider_75 = Slider(23, range=0..100)  # disabled
number_slider_76 = Slider(13, range=0..100)  # disabled
radians_2 = Radians(Degrees=number_slider_75)  # disabled
number_slider_77 = Slider(1, range=1..5)  # disabled
number_slider_78 = Slider(1, range=1..5)  # disabled
vector_star_3 = VectorStar(Plane=PlaneXY(0, 0, 0), Steps=number_slider_77, SubdivisionType=0, Dimensionality=True)  # -> Vectors, Lines; disabled
vector_star_4 = VectorStar(Plane=PlaneXY(0, 0, 0), Steps=number_slider_78, SubdivisionType=0, Dimensionality=True)  # -> Vectors, Lines; disabled
value_list_2 = ValueList({"RTree": 1, "Grid": 2, "Field (could be long)": 0}, selected="RTree")  # disabled
number_slider_79 = Slider(50, range=0..100)  # disabled
number_slider_80 = Slider(392, range=0..10000)  # disabled

# ----
# Karamba3d
crv_8 = Curve(timber_reader_2.timber_holes)
crv_9 = Curve(timber_reader_2.timber_contour)
boundary_2 = BoundarySurfaces(Edges=[crv_9, crv_8])
number_slider_81 = Slider(0.001, range=0..0.001)
area = Area(Geometry=boundary_2)  # -> Area, Centroid
scale = Scale(Geometry=boundary_2, Center=area.Centroid, Factor=number_slider_81)  # -> Geometry, Transform
unit_z = UnitZ(Factor=Slider(0.75, range=0..1))
move_3 = Move(Geometry=scale.Geometry, Motion=unit_z)  # -> Geometry, Transform; disabled
md_slider_5 = MDSlider(
    SliderMode=0,
    slider_value=Point(0.6535130943, 0.987694717, 0.5),
    x_domain=Domain(0, 1),
    y_domain=Domain(0, 1),
    z_domain=Domain(0, 1))  # disabled
md_slider_6 = MDSlider(
    SliderMode=0,
    slider_value=Point(0.5690620236, 0.3428106541, 0.5),
    x_domain=Domain(0, 1),
    y_domain=Domain(0, 1),
    z_domain=Domain(0, 1))  # disabled
evaluate_surface = EvaluateSurface(Surface=reparameterize(move_3.Geometry), Point=[md_slider_5, md_slider_6])  # -> Point, Normal, UDirection, VDirection, Frame; disabled
surface = Surface(move_3.Geometry)  # disabled
number_slider_82 = Slider(83, range=0..100)  # disabled
number_slider_83 = Slider(49, range=0..100)  # disabled
number_slider_84 = Slider(6, range=0..100)  # disabled
number_slider_85 = Slider(10, range=0..100)  # disabled
mesh_uv = MeshSurface(Surface=surface, UCount=number_slider_82, VCount=number_slider_83, Overhang=True, Equalize=False)  # disabled
mesh_uv_2 = MeshSurface(Surface=surface, UCount=number_slider_85, VCount=number_slider_84, Overhang=True, Equalize=False)  # disabled
tri = Triangulate(Mesh=mesh_uv)  # -> Mesh, Count; disabled
demesh = DeconstructMesh(Mesh=mesh_uv_2)  # -> Vertices, Faces, Colours, Normals; disabled
demesh_2 = DeconstructMesh(Mesh=tri.Mesh)  # -> Vertices, Faces, Colours, Normals; disabled
matselect_3 = MaterialSelectionKaramba3D(menu=[dropdown(0), dropdown(2), dropdown(1)])  # disabled
number_slider_86 = Slider(2, range=0..100)  # disabled
cps = ClosestPoints(Point=evaluate_surface.Point, Cloud=demesh_2.Vertices, Count=4)  # -> flatten(ClosestPoint), CPIndex, Distance; disabled
shell_const_3 = CrossSectionKaramba3D(FamilyNameOfCrossSection="DefaultCroSec", Material=matselect_3, Height_cm=number_slider_86, mode="Shell - Const")  # disabled
supp = SupportKaramba3D(PosInd=cps.ClosestPoint, Ct_kN_m=Vector(0, 0, 0), Cr_kNm_rad=Vector(0, 0, 0), menu=[buttons(on, on, on, off, off, on)])  # disabled
# Design
mtoshell = CreateSurfaceElementKaramba3D(
    Mesh=tri.Mesh,
    CrossSection=shell_const_3,
    LimitDistance_m=0.005,
    Bending=True,
    mode="MeshToShell",
    GuidGeneratorSeed=1729072587)  # -> Element, Points, Info; disabled
element_karamba3d = ElementKaramba3D(flatten(mtoshell.Element))  # disabled
support_karamba3d = SupportKaramba3D(flatten(supp))  # disabled

scale_2 = Scale(Geometry=boundary_2, Center=area.Centroid, Factor=number_slider_81)  # -> Geometry, Transform; disabled
scale_3 = Scale(Geometry=boundary_2, Center=area.Centroid, Factor=number_slider_81)  # -> Geometry, Transform; disabled

# ---- group: Assemble Model (Karamba3D)
assemble = AssembleModelKaramba3D(Elem=element_karamba3d, Support=flatten(support_karamba3d), Load=gravity_3, LimitDistance_m=0.005)  # -> Model, Info, Mass_kg, CentreOfGravity, LoadCaseNames; disabled

# ---- group: Analyse (Karamba3D)
analyse = AnalyseKaramba3D(Model=assemble.Model)  # -> AnalysedModel, MaximumDisplacement_cm, ResultingForce_kN, ChangeOfElasticEnergy_kNm; disabled

# ----
model_karamba3d = ModelKaramba3D(analyse.AnalysedModel)  # disabled
princmoment = LineResultsOnShellsKaramba3D(
    AnalysedModel=model_karamba3d,
    ListOfSourcesOfForceFlowLinesLinesPoints=demesh.Vertices,
    SegmentLength_m=0.5,
    DA_deg=5,
    mode="PrincMoment")  # -> Model, Lines1, Lines2; disabled

evalsrf = EvaluateSurface(Surface=reparameterize(scale_3.Geometry), Point=md_slider)  # -> Point, Normal, UDirection, VDirection, Frame; disabled
number_slider_87 = Slider(1000, range=0..1000)  # disabled
group = Group(Geometry=flatten(princmoment.Lines1))  # disabled
group_2 = Group(Geometry=flatten(princmoment.Lines2))  # disabled
scale_4 = Scale(Geometry=group, Center=area.Centroid, Factor=number_slider_87)  # -> Geometry, Transform; disabled
scale_5 = Scale(Geometry=group_2, Center=area.Centroid, Factor=number_slider_87)  # -> Geometry, Transform; disabled
ungroup = Ungroup(Group=scale_4.Geometry)  # disabled
list = ValueList({"RTree": 1, "Grid": 2, "Field (could be long)": 0}, selected="RTree")  # disabled
list_2 = ValueList({"RTree": 1, "Grid": 2, "Field (could be long)": 0}, selected="RTree")  # disabled
ungroup_2 = Ungroup(Group=scale_5.Geometry)  # disabled
number_slider_88 = Slider(1, range=0..10)  # disabled
number_slider_89 = Slider(14, range=0..100)  # disabled
join = JoinCurves(Curves=ungroup, Preserve=False)  # disabled
number_slider_90 = Slider(50, range=0..100)  # disabled
join_2 = JoinCurves(Curves=ungroup_2, Preserve=False)  # disabled
vecstar = VectorStar(Plane=PlaneXY(0, 0, 0), Steps=number_slider_88, SubdivisionType=0, Dimensionality=True)  # -> Vectors, Lines; disabled
number_slider_91 = Slider(11, range=0..100)  # disabled
number_slider_92 = Slider(18, range=0..100)  # disabled
vecworld = VectorWorld(Plane=PlaneXY(0, 0, 0), DirectionType=2, Dimensionality=True)  # -> Vectors, Lines; disabled
number_slider_93 = Slider(23, range=0..100)  # disabled
number_slider_94 = Slider(10, range=0..100)  # disabled
rad = Radians(Degrees=number_slider_93)  # disabled
rad_2 = Radians(Degrees=number_slider_93)  # disabled
simplify = SimplifyCurve(Curve=join_2, Tolerance=number_slider_91, AngleTolerance=rad_2)  # -> Curve, Simplified; disabled
explode_3 = Explode(Curve=simplify.Curve, Recursive=True)  # -> Segments, Vertices; disabled
simplify_2 = SimplifyCurve(Curve=join, Tolerance=number_slider_91, AngleTolerance=rad)  # -> Curve, Simplified; disabled
explode_4 = Explode(Curve=simplify_2.Curve, Recursive=True)  # -> Segments, Vertices; disabled
dpline = DiscretePolyline(References=explode_4.Vertices, Targets=vecstar.Vectors, KeepLength=False)  # -> flatten(Discrete); disabled
dpline_2 = DiscretePolyline(References=explode_3.Vertices, Targets=vecstar.Vectors, KeepLength=False)  # -> flatten(Discrete); disabled
number_slider_95 = Slider(0, range=0..1000)  # disabled
cleanoverlapcurves = CleanOverlappingCurves(Curves=dpline_2, Distance=number_slider_90, LimitLength=2, OverSampling=5, Method=list_2)  # -> Curves, Polylines; disabled
cleanoverlapcurves_2 = CleanOverlappingCurves(Curves=dpline, Distance=number_slider_90, LimitLength=2, OverSampling=5, Method=list)  # -> Curves, Polylines; disabled
number_slider_96 = Slider(200, range=0..1000)  # disabled
len = Length(Curve=cleanoverlapcurves_2.Curves)  # disabled
len_2 = Length(Curve=cleanoverlapcurves.Curves)  # disabled
larger = LargerThan(FirstNumber=len, SecondNumber=number_slider_95)  # -> LargerThan, OrEqualTo; disabled
cull = CullPattern(List=cleanoverlapcurves_2.Curves, CullPattern=larger.LargerThan)  # disabled
larger_2 = LargerThan(FirstNumber=len_2, SecondNumber=number_slider_95)  # -> LargerThan, OrEqualTo; disabled
cull_2 = CullPattern(List=cleanoverlapcurves.Curves, CullPattern=larger_2.LargerThan)  # disabled

mesh_surface = MeshSurface(Surface=scale_3.Geometry, UCount=number_slider_5, VCount=number_slider_5, Overhang=True, Equalize=False)  # disabled
srf = Surface(scale_3.Geometry)  # disabled
evalsrf_2 = EvaluateSurface(Surface=reparameterize(scale_3.Geometry), Point=md_slider_2)  # -> Point, Normal, UDirection, VDirection, Frame; disabled
pt = Point(evalsrf_2.Point)  # disabled
deconstruct_mesh = DeconstructMesh(Mesh=mesh_surface)  # -> Vertices, Faces, Colours, Normals; disabled
move_4 = Move(Geometry=pt, Motion=neg)  # -> Geometry, Transform; disabled
pt_2 = Point(pt)  # disabled
ln = Line(StartPoint=move_4.Geometry, EndPoint=pt)  # disabled
linetobeam = CreateLinearElementKaramba3D(
    Line=ln,
    CrossSection=trapezoid,
    LimitDistance_m=0.005,
    BucklingLengthY_m=-1,
    BucklingLengthZ_m=-1,
    BucklingLengthLT_m=-1,
    Bending=True,
    ToPolylineMaxAngle=0.25,
    ToPolylineTolerance=0.1,
    ToPolylineMaxEdgeLength=0.25,
    New=True,
    Remove=True,
    mode="LineToBeam",
    GuidGeneratorSeed=1116552810)  # -> Element, Points, Info; disabled
supp_2 = SupportKaramba3D(PosInd=move_4.Geometry, Ct_kN_m=Vector(0, 0, 0), Cr_kNm_rad=Vector(0, 0, 0), menu=[buttons(on, on, on, off, on, on)])  # disabled
pt_3 = Point(pt_2)  # disabled
pdecon = Deconstruct(Point=pt_3)  # -> XComponent, YComponent, ZComponent; disabled
pt_4 = ConstructPoint(XCoordinate=panel_8, YCoordinate=pdecon.YComponent, ZCoordinate=pdecon.ZComponent)  # disabled
cir = Circle(Plane=pt_3, Radius=number_slider_6)  # disabled
ln_2 = Line(StartPoint=pt_3, EndPoint=evalsrf.Point)  # disabled
divide = DivideCurve(Curve=cir, Count=number_slider_9, Kinks=False)  # -> Points, Tangents, Parameters; disabled
eval = EvaluateCurve(Curve=reparameterize(ln_2), Parameter=range)  # -> Point, Tangent, Angle; disabled
area_2 = Area(Geometry=scale_3.Geometry)  # -> Area, Centroid; disabled

# ---- group: Mesh Breps (Karamba3D)
mesh_breps = MeshBrepsKaramba3D(
    Brep=srf,
    InclusionPoints=pt,
    MeshResolution=panel_6,
    EdgeRefinementFactor=0.67,
    PointReduction=False,
    SmoothingStepSize=0,
    SmoothingIterations=5)  # -> Mesh, Info; disabled

# ----
mesh_surface_2 = MeshSurface(Surface=scale_2.Geometry, UCount=number_slider_27, VCount=number_slider_27, Overhang=True, Equalize=False)  # disabled
srf_2 = Surface(scale_2.Geometry)  # disabled
evalsrf_3 = EvaluateSurface(Surface=reparameterize(scale_2.Geometry), Point=[md_slider_3, md_slider_4])  # -> Point, Normal, UDirection, VDirection, Frame; disabled
pt_5 = Point(evalsrf_3.Point)  # disabled
deconstruct_mesh_2 = DeconstructMesh(Mesh=mesh_surface_2)  # -> Vertices, Faces, Colours, Normals; disabled
move_5 = Move(Geometry=pt_5, Motion=neg_2)  # -> Geometry, Transform; disabled
pt_6 = Point(pt_5)  # disabled
ln_3 = Line(StartPoint=move_5.Geometry, EndPoint=pt_5)  # disabled
linetobeam_2 = CreateLinearElementKaramba3D(
    Line=ln_3,
    CrossSection=trapezoid_2,
    LimitDistance_m=0.005,
    BucklingLengthY_m=-1,
    BucklingLengthZ_m=-1,
    BucklingLengthLT_m=-1,
    Bending=True,
    ToPolylineMaxAngle=0.25,
    ToPolylineTolerance=0.1,
    ToPolylineMaxEdgeLength=0.25,
    New=True,
    Remove=True,
    mode="LineToBeam",
    GuidGeneratorSeed=-677529633)  # -> Element, Points, Info; disabled
supp_3 = SupportKaramba3D(PosInd=move_5.Geometry, Ct_kN_m=Vector(0, 0, 0), Cr_kNm_rad=Vector(0, 0, 0), menu=[buttons(on, on, on, off, on, on)])  # disabled
pt_7 = Point(pt_6)  # disabled
pdecon_2 = Deconstruct(Point=pt_7)  # -> XComponent, YComponent, ZComponent; disabled
pt_8 = ConstructPoint(XCoordinate=panel_17, YCoordinate=pdecon_2.YComponent, ZCoordinate=pdecon_2.ZComponent)  # disabled
cir_2 = Circle(Plane=pt_7, Radius=number_slider_28)  # disabled
ln_4 = Line(StartPoint=pt_7, EndPoint=pt_8)  # disabled
divide_2 = DivideCurve(Curve=cir_2, Count=number_slider_43, Kinks=False)  # -> Points, Tangents, Parameters; disabled
eval_2 = EvaluateCurve(Curve=reparameterize(ln_4), Parameter=range_2)  # -> Point, Tangent, Angle; disabled
area_3 = Area(Geometry=scale_2.Geometry)  # -> Area, Centroid; disabled

# ---- group: Mesh Breps (Karamba3D)
mesh_breps_2 = MeshBrepsKaramba3D(
    Brep=srf_2,
    InclusionPoints=pt_5,
    MeshResolution=panel_15,
    EdgeRefinementFactor=0.67,
    PointReduction=False,
    SmoothingStepSize=0,
    SmoothingIterations=5)  # -> Mesh, Info; disabled

# ----
edges = BrepEdges(Brep=scale_3.Geometry)  # -> Naked, Interior, NonManifold; disabled
midpt = CurveMiddle(Curve=edges.Naked)  # disabled
pdecon_3 = Deconstruct(Point=midpt)  # -> XComponent, YComponent, ZComponent; disabled
sort = SortList(Keys=pdecon_3.XComponent, ValuesA=edges.Naked)  # -> Keys, ValuesA; disabled
sort_2 = SortList(Keys=pdecon_3.YComponent, ValuesA=edges.Naked)  # -> Keys, ValuesA; disabled
item = ListItem(List=reverse(sort.ValuesA), Index=0, Wrap=True)  # disabled
item_2 = ListItem(List=reverse(sort_2.ValuesA), Index=0, Wrap=True)  # disabled
number_slider_97 = Slider(0.01, range=0..0.01)  # disabled
number_slider_98 = Slider(0.01, range=0..0.01)  # disabled

edges_2 = BrepEdges(Brep=scale_2.Geometry)  # -> Naked, Interior, NonManifold; disabled
midpt_2 = CurveMiddle(Curve=edges_2.Naked)  # disabled
pdecon_4 = Deconstruct(Point=midpt_2)  # -> XComponent, YComponent, ZComponent; disabled
sort_3 = SortList(Keys=pdecon_4.XComponent, ValuesA=edges_2.Naked)  # -> Keys, ValuesA; disabled
sort_4 = SortList(Keys=pdecon_4.YComponent, ValuesA=edges_2.Naked)  # -> Keys, ValuesA; disabled
item_3 = ListItem(List=reverse(sort_3.ValuesA), Index=0, Wrap=True)  # disabled
item_4 = ListItem(List=reverse(sort_4.ValuesA), Index=0, Wrap=True)  # disabled
number_slider_99 = Slider(0.01, range=0..0.01)  # disabled
number_slider_100 = Slider(0.01, range=0..0.01)  # disabled

mtoshell_2 = CreateSurfaceElementKaramba3D(
    Mesh=mesh_breps.Mesh,
    CrossSection=shell_const,
    LimitDistance_m=0.005,
    Bending=True,
    mode="MeshToShell",
    GuidGeneratorSeed=-1909979880)  # -> Element, Points, Info; disabled
element = ElementKaramba3D(flatten([linetobeam.Element, mtoshell_2.Element]))  # disabled

pull = PullPoint(Point=mtoshell_2.Points, Geometry=item, ClosestOnly=True)  # -> ClosestPoint, Distance, Index; disabled
pull_2 = PullPoint(Point=mtoshell_2.Points, Geometry=item_2, ClosestOnly=True)  # -> ClosestPoint, Distance, Index; disabled
smaller = SmallerThan(FirstNumber=pull.Distance, SecondNumber=number_slider_97)  # -> SmallerThan, OrEqualTo; disabled
cull_3 = CullPattern(List=mtoshell_2.Points, CullPattern=smaller.OrEqualTo)  # disabled
smaller_2 = SmallerThan(FirstNumber=pull_2.Distance, SecondNumber=number_slider_98)  # -> SmallerThan, OrEqualTo; disabled
cull_4 = CullPattern(List=mtoshell_2.Points, CullPattern=smaller_2.OrEqualTo)  # disabled

mtoshell_3 = CreateSurfaceElementKaramba3D(
    Mesh=mesh_breps_2.Mesh,
    CrossSection=shell_const_2,
    LimitDistance_m=0.005,
    Bending=True,
    mode="MeshToShell",
    GuidGeneratorSeed=-426365028)  # -> Element, Points, Info; disabled
element_2 = ElementKaramba3D(flatten([linetobeam_2.Element, mtoshell_3.Element]))  # disabled

pull_3 = PullPoint(Point=mtoshell_3.Points, Geometry=item_3, ClosestOnly=True)  # -> ClosestPoint, Distance, Index; disabled
pull_4 = PullPoint(Point=mtoshell_3.Points, Geometry=item_4, ClosestOnly=True)  # -> ClosestPoint, Distance, Index; disabled
smaller_3 = SmallerThan(FirstNumber=pull_3.Distance, SecondNumber=number_slider_99)  # -> SmallerThan, OrEqualTo; disabled
cull_5 = CullPattern(List=mtoshell_3.Points, CullPattern=smaller_3.OrEqualTo)  # disabled
smaller_4 = SmallerThan(FirstNumber=pull_4.Distance, SecondNumber=number_slider_100)  # -> SmallerThan, OrEqualTo; disabled
cull_6 = CullPattern(List=mtoshell_3.Points, CullPattern=smaller_4.OrEqualTo)  # disabled

difference = SetDifference(SetA=cull_5, SetB=cull_6)  # disabled

supp_4 = SupportKaramba3D(PosInd=cull_4, Ct_kN_m=Vector(0, 0, 0), Cr_kNm_rad=Vector(0, 0, 0), menu=[buttons(off, on, off, on, off, off)])  # disabled
supp_5 = SupportKaramba3D(PosInd=cull_3, Ct_kN_m=Vector(0, 0, 0), Cr_kNm_rad=Vector(0, 0, 0), menu=[buttons(on, off, off, off, on, off)])  # disabled
support = SupportKaramba3D(flatten([supp_2, supp_4, supp_5]))  # disabled

# ---- group: Assemble Model (Karamba3D)
assemble_2 = AssembleModelKaramba3D(Elem=element, Support=flatten(support), Load=gravity, LimitDistance_m=0.005)  # -> Model, Info, Mass_kg, CentreOfGravity, LoadCaseNames; disabled

# ---- group: Analyse (Karamba3D)
analyse_2 = AnalyseKaramba3D(Model=assemble_2.Model)  # -> AnalysedModel, MaximumDisplacement_cm, ResultingForce_kN, ChangeOfElasticEnergy_kNm; disabled

# ---- group: Model View (Karamba3D)
modelview = ModelViewKaramba3D(Model=analyse_2.AnalysedModel)  # -> Model, DeformedMesh, DeformedAxes, DeformedModel, MaximumDeformation; disabled

# ---- group: Beam View (Karamba3D)
beamview = BeamViewKaramba3D(Model=modelview.Model)  # -> Model, MeshesOfRenderedBeams, DeformedBeamAxes, LegendColours, LegendTags; disabled

# ---- group: Shell View (Karamba3D)
shellview = ShellViewKaramba3D(Model=modelview.Model, IndexOfLayer=0)  # -> Model, MeshesOfRenderedShells, LegendColours, LegendTags; disabled

# ----
model = ModelKaramba3D(analyse_2.AnalysedModel)  # disabled
princmoment_2 = LineResultsOnShellsKaramba3D(
    AnalysedModel=model,
    ListOfSourcesOfForceFlowLinesLinesPoints=divide.Points,
    SegmentLength_m=0.5,
    DA_deg=5,
    mode="PrincMoment")  # -> Model, Lines1, Lines2; disabled
princmoment_3 = LineResultsOnShellsKaramba3D(
    AnalysedModel=model,
    ListOfSourcesOfForceFlowLinesLinesPoints=eval.Point,
    SegmentLength_m=0.5,
    DA_deg=5,
    mode="PrincMoment")  # -> Model, Lines1, Lines2; disabled
cull_curves = CullCurvesKaramba3D(Curves=princmoment_3.Lines2, LimitDistance=number_slider_14, NumberOfSamplePoints=number_slider_13)  # disabled
group_3 = Group(Geometry=flatten(princmoment_3.Lines2))  # disabled
group_4 = Group(Geometry=flatten(princmoment_2.Lines1))  # disabled
tree_branch = TreeBranch(Tree=princmoment_3.Lines2, Path=panel_11, MaintainPaths=True)  # disabled
tree_branch_2 = TreeBranch(Tree=princmoment_3.Lines2, Path=panel_12, MaintainPaths=True)  # disabled
tree_branch_3 = TreeBranch(Tree=princmoment_3.Lines2, Path=panel_10, MaintainPaths=True)  # disabled
tree_branch_4 = TreeBranch(Tree=princmoment_3.Lines2, Path=panel_13, MaintainPaths=True)  # disabled
curve = Curve(cull_curves)  # disabled
scale_6 = Scale(Geometry=group_3, Center=area_2.Centroid, Factor=number_slider_15)  # -> Geometry, Transform; disabled
join_curves = JoinCurves(Curves=tree_branch_2, Preserve=False)  # disabled
join_curves_2 = JoinCurves(Curves=tree_branch_4, Preserve=False)  # disabled
join_curves_3 = JoinCurves(Curves=tree_branch, Preserve=False)  # disabled
join_curves_4 = JoinCurves(Curves=tree_branch_3, Preserve=False)  # disabled
scale_7 = Scale(Geometry=group_4, Center=area_2.Centroid, Factor=number_slider_15)  # -> Geometry, Transform; disabled
merge = Merge(Data1=join_curves_4, Data2=join_curves, Data3=princmoment_2.Lines1)  # -> flatten(Result); disabled
ungroup_3 = Ungroup(Group=scale_7.Geometry)  # disabled
scale_8 = Scale(Geometry=merge, Center=area_2.Centroid, Factor=number_slider_16)  # -> Geometry, Transform; disabled
ungroup_4 = Ungroup(Group=scale_6.Geometry)  # disabled
join_curves_5 = JoinCurves(Curves=ungroup_4, Preserve=False)  # disabled
join_curves_6 = JoinCurves(Curves=ungroup_3, Preserve=False)  # disabled
simplify_curve = SimplifyCurve(Curve=join_curves_5, Tolerance=number_slider_18, AngleTolerance=radians)  # -> Curve, Simplified; disabled
simplify_curve_2 = SimplifyCurve(Curve=join_curves_6, Tolerance=number_slider_18, AngleTolerance=radians)  # -> Curve, Simplified; disabled
explode_5 = Explode(Curve=simplify_curve_2.Curve, Recursive=True)  # -> Segments, Vertices; disabled
explode_6 = Explode(Curve=simplify_curve.Curve, Recursive=True)  # -> Segments, Vertices; disabled
discrete_polyline = DiscretePolyline(References=explode_6.Vertices, Targets=vector_star_2.Vectors, KeepLength=False)  # disabled
discrete_polyline_2 = DiscretePolyline(References=explode_5.Vertices, Targets=vector_star.Vectors, KeepLength=False)  # disabled
clean_overlapping_curves = CleanOverlappingCurves(Curves=discrete_polyline, Distance=number_slider_21, LimitLength=2, OverSampling=5, Method=value_list)  # -> Curves, Polylines; disabled
clean_overlapping_curves_2 = CleanOverlappingCurves(Curves=discrete_polyline_2, Distance=number_slider_21, LimitLength=2, OverSampling=5, Method=value_list)  # -> Curves, Polylines; disabled
length = Length(Curve=clean_overlapping_curves.Curves)  # disabled
length_2 = Length(Curve=clean_overlapping_curves_2.Curves)  # disabled
larger_than = LargerThan(FirstNumber=length, SecondNumber=number_slider_22)  # -> LargerThan, OrEqualTo; disabled
larger_than_2 = LargerThan(FirstNumber=length_2, SecondNumber=number_slider_22)  # -> LargerThan, OrEqualTo; disabled
cull_pattern = CullPattern(List=clean_overlapping_curves.Curves, CullPattern=larger_than.LargerThan)  # disabled
cull_pattern_2 = CullPattern(List=clean_overlapping_curves_2.Curves, CullPattern=larger_than_2.LargerThan)  # disabled
merge_2 = Merge(Data1=cull_pattern, Data2=cull_pattern_2)  # disabled

projector_live_sender = Python3Script(
    main_border=crv_6,
    timber_color=ColourSwatch(SwatchColor=RGB(255, 255, 255)),
    timber_width=number_slider_2,
    hand_drawing=crv_7,
    hand_drawing_color=ColourSwatch(SwatchColor=RGB(242, 227, 19)),
    cut=scale_8.Geometry,
    cut_color=swatch,
    cut_thickness=number_slider_2,
    mill=flatten(merge_2),
    mill_color=swatch_2,
    mill_thickness=number_slider_2,
    point_color=swatch_2,
    label_color=swatch,
    label_scale=Slider(0.898, range=0..5),
    active=Toggle(True))  # -> out, status; inputs main_border: list of Curve, timber_color: Color, timber_width: tree of Int32, hand_drawing: list of Curve, hand_drawing_color: Color, cut: list of Curve, cut_color: list of Color, cut_thickness: Int32, mill: list of Curve, mill_thickness: Int32, points: list of Point3d, point_color: Color, drill_size: Int32, labels: list of String, label_points: list of Point3d, label_color: Color, label_scale: Double, thickness: Double, active: Boolean
# ---------- projector_live_sender: Python ----------
# Grasshopper Python 3 sender.
# Add hand_drawing: Curve type hint, Tree access.
# Add hand_drawing_color: Colour type hint, Item access (Colour Swatch).
# Coordinates use the existing world XY convention; model units must be mm.
import math
import json
import socket
import time
import datetime

# Rhino imports with safe fallback for testing
try:
    import Rhino.Geometry as rg
    import System.Drawing as sd
    IN_RHINO = True
except ImportError:
    rg = None
    sd = None
    IN_RHINO = False


# ============================================================
# DATATREE & SCALAR EXTRACTION HELPERS
# ============================================================

def flatten_input(val):
    """Recursively flatten any Grasshopper DataTree, list, or nested collection."""
    if val is None:
        return []
    if hasattr(val, "AllData"):
        try:
            return list(val.AllData())
        except Exception:
            pass
    if hasattr(val, "Branches"):
        try:
            out = []
            for b in val.Branches:
                for item in b:
                    out.append(item)
            return out
        except Exception:
            pass
    if isinstance(val, (list, tuple)):
        out = []
        for item in val:
            if isinstance(item, (list, tuple)) or hasattr(item, "AllData") or hasattr(item, "Branches"):
                out.extend(flatten_input(item))
            else:
                out.append(item)
        return out
    return [val]


def extract_single_scalar(val, default=None):
    """Safely extract a single scalar from any DataTree, list, or primitive."""
    if val is None:
        return default
    if isinstance(val, (int, float, bool)):
        return val
    if isinstance(val, str):
        try:
            return val.strip().strip('"').strip("'")
        except Exception:
            return val

    # 1. Try AllData
    if hasattr(val, "AllData"):
        try:
            for item in val.AllData():
                res = extract_single_scalar(item, None)
                if res is not None:
                    return res
        except Exception:
            pass

    # 2. Try Branches
    if hasattr(val, "Branches"):
        try:
            for b in val.Branches:
                for item in b:
                    res = extract_single_scalar(item, None)
                    if res is not None:
                        return res
        except Exception:
            pass

    # 3. Try Branch(0)
    if hasattr(val, "Branch"):
        try:
            b = val.Branch(0)
            if len(b) > 0:
                return extract_single_scalar(b[0], default)
        except Exception:
            pass

    # 4. Try indexing or iteration
    try:
        for item in val:
            res = extract_single_scalar(item, None)
            if res is not None:
                return res
    except Exception:
        pass

    try:
        return val[0]
    except Exception:
        pass

    return default


def to_int(val, default_val=0):
    """Convert any DataTree, string, float, or integer to a clean integer."""
    if val is None:
        return default_val
    scalar = extract_single_scalar(val, None)
    if scalar is None:
        return default_val
    try:
        return int(float(str(scalar).strip().strip('"').strip("'")))
    except (ValueError, TypeError):
        return default_val


def to_float(val, default_val=None):
    """Convert any DataTree, string, or number to a clean float."""
    if val is None:
        return default_val
    scalar = extract_single_scalar(val, None)
    if scalar is None:
        return default_val
    try:
        return float(str(scalar).strip().strip('"').strip("'"))
    except (ValueError, TypeError):
        return default_val



def to_bool(val, default_val=True):
    """Convert any DataTree or value to boolean."""
    scalar = extract_single_scalar(val, default_val)
    if scalar is None:
        return default_val
    if isinstance(scalar, bool):
        return scalar
    s_str = str(scalar).strip().lower()
    return s_str in ("true", "1", "yes", "on")


def extract_rgb(color_in, default_rgb=None):
    """Read a swatch, GH_Colour, tree, RGB tuple, or six-digit hex."""
    fallback = list(default_rgb if default_rgb is not None else [255, 255, 255])
    if color_in is None:
        return fallback
    if hasattr(color_in, "Value"):
        return extract_rgb(color_in.Value, fallback)
    if all(hasattr(color_in, channel) for channel in ("R", "G", "B")):
        return [int(color_in.R), int(color_in.G), int(color_in.B)]
    if isinstance(color_in, str):
        value = color_in.strip().strip('"').strip("'").lstrip("#")
        if len(value) == 6:
            try:
                return [int(value[i:i + 2], 16) for i in (0, 2, 4)]
            except ValueError:
                pass
        return fallback
    if isinstance(color_in, (list, tuple)) and len(color_in) >= 3:
        try:
            return [max(0, min(255, int(v))) for v in color_in[:3]]
        except (ValueError, TypeError, OverflowError):
            pass
    items = flatten_input(color_in)
    if items and items[0] is not color_in:
        return extract_rgb(items[0], fallback)
    return fallback


def curve_to_polyline_pts(curve_obj, max_chord_error=0.5):
    """Convert any Rhino Curve, Line, Arc, or Polyline into a list of [X, Y] points (mm)."""
    if curve_obj is None:
        return []

    if hasattr(curve_obj, "Value"):
        curve_obj = curve_obj.Value

    # If already a list of points or raw coordinate lists
    if isinstance(curve_obj, (list, tuple)):
        if len(curve_obj) > 0 and isinstance(curve_obj[0], (list, tuple, rg.Point3d if rg else tuple)):
            pts_out = []
            for p in curve_obj:
                if hasattr(p, "Value"):
                    p = p.Value
                if hasattr(p, "X") and hasattr(p, "Y"):
                    pts_out.append([round(float(p.X), 2), round(float(p.Y), 2)])
                elif isinstance(p, (list, tuple)) and len(p) >= 2:
                    pts_out.append([round(float(p[0]), 2), round(float(p[1]), 2)])
            return pts_out

    if not IN_RHINO or rg is None:
        return []

    # If Rhino Curve
    if isinstance(curve_obj, rg.Curve):
        pline_try = None
        success, pline = curve_obj.TryGetPolyline()
        if success and pline is not None:
            return [[round(p.X, 2), round(p.Y, 2)] for p in pline]

        poly_curve = curve_obj.ToPolyline(max_chord_error, 0.1, 0.0, 0.0)
        if poly_curve:
            return [[round(poly_curve.Point(i).X, 2), round(poly_curve.Point(i).Y, 2)] for i in range(poly_curve.PointCount)]

        div_count = max(8, int(curve_obj.GetLength() / 5.0))
        params = curve_obj.DivideByCount(div_count, True)
        if params:
            return [[round(curve_obj.PointAt(t).X, 2), round(curve_obj.PointAt(t).Y, 2)] for t in params]

    elif isinstance(curve_obj, rg.Line):
        return [
            [round(curve_obj.From.X, 2), round(curve_obj.From.Y, 2)],
            [round(curve_obj.To.X, 2), round(curve_obj.To.Y, 2)]
        ]

    elif isinstance(curve_obj, rg.Polyline):
        return [[round(p.X, 2), round(p.Y, 2)] for p in curve_obj]

    return []


def closed_curve_to_polygon(curve_obj):
    """Project a closed curve to world XY; return a closed polygon ring."""
    if hasattr(curve_obj, "Value"):
        curve_obj = curve_obj.Value
    if curve_obj is None or not bool(getattr(curve_obj, "IsClosed", False)):
        return []
    if not bool(getattr(curve_obj, "IsValid", True)):
        return []
    pts = curve_to_polyline_pts(curve_obj)
    ring = []
    for pt in pts:
        if not all(math.isfinite(v) for v in pt):
            return []
        if not ring or pt != ring[-1]:
            ring.append(pt)
    if len(ring) > 1 and ring[-1] == ring[0]:
        ring.pop()
    if len(set(tuple(pt) for pt in ring)) < 3:
        return []
    # Reject rings that collapse to a line after projection / rounding.
    a = ring[0]
    b = next(pt for pt in ring[1:] if pt != a)
    if not any(abs((b[0] - a[0]) * (p[1] - a[1]) -
                   (b[1] - a[1]) * (p[0] - a[0])) > 1e-10 for p in ring[2:]):
        return []
    ring.append(list(ring[0]))
    return ring


def point_to_xy(pt_obj):
    """Extract [X, Y] in mm from Point3d or coordinate list."""
    if pt_obj is None:
        return None
    if hasattr(pt_obj, "Value"):
        pt_obj = pt_obj.Value
    if hasattr(pt_obj, "Location"):
        pt_obj = pt_obj.Location
    if hasattr(pt_obj, "X") and hasattr(pt_obj, "Y"):
        return [round(float(pt_obj.X), 2), round(float(pt_obj.Y), 2)]
    if isinstance(pt_obj, (list, tuple)) and len(pt_obj) >= 2:
        return [round(float(pt_obj[0]), 2), round(float(pt_obj[1]), 2)]
    return None


# ============================================================
# HARDCODED PROJECTOR VIEWER CONNECTION SETTINGS
# ============================================================
HOST = "127.0.0.1"
PORT = 9999


# ============================================================
# MAIN SENDER EXECUTION
# ============================================================

# 1. Inputs with defaults
is_active = to_bool(globals().get("active", True), True)

raw_host = extract_single_scalar(globals().get("host", None))
if raw_host is not None:
    cleaned_host = str(raw_host).strip().strip('"').strip("'")
    if cleaned_host in ("0.0.0.0", "", "None", "localhost", "0"):
        target_host = HOST
    else:
        target_host = cleaned_host
else:
    target_host = HOST

target_port = to_int(globals().get("port", PORT), PORT)

timber_input = globals().get("main_border", None)
timber_col_in = globals().get("timber_color", None)
timber_rgb = extract_rgb(timber_col_in, [255, 255, 255])

cut_input = globals().get("cut", [])
cut_col_in = globals().get("cut_color", None)
cut_rgb = extract_rgb(cut_col_in, [255, 30, 30])

mill_input = globals().get("mill", [])
mill_col_in = globals().get("mill_color", None)
mill_rgb = extract_rgb(mill_col_in, [0, 220, 255])

points_input = globals().get("points", [])
pt_col_in = globals().get("point_color", None)
point_rgb = extract_rgb(pt_col_in, [0, 255, 100])

labels_input = globals().get("labels", [])
label_pts_input = globals().get("label_points", [])
label_col_in = globals().get("label_color", None)
label_rgb = extract_rgb(label_col_in, [255, 180, 0])

hand_drawing_input = globals().get("hand_drawing", [])
hand_drawing_rgb = extract_rgb(globals().get("hand_drawing_color", None), [255, 255, 255])

thickness_val = to_float(globals().get("thickness", None), None)

if not is_active:
    status = "Paused (active = False)"
else:
    # ============================================================
    # 2. PROCESS MULTIPLE TIMBER CONTOURS
    # ============================================================

    contour_list = []

    if timber_input is not None:

        flat_timber = flatten_input(
            timber_input
        )

        for item in flat_timber:

            pts = curve_to_polyline_pts(
                item
            )

            if pts and len(pts) >= 3:

                # IMPORTANT:
                # append keeps every timber as a separate contour
                contour_list.append(
                    pts
                )

    # 3. Process Cut Curves (supports list or grafted DataTree)
    cut_list = []
    if cut_input is not None:
        flat_cuts = flatten_input(cut_input)
        for item in flat_cuts:
            pts = curve_to_polyline_pts(item)
            if pts and len(pts) >= 2:
                cut_list.append(pts)

    # 4. Process Mill Curves (supports list or grafted DataTree)
    mill_list = []
    if mill_input is not None:
        flat_mills = flatten_input(mill_input)
        for item in flat_mills:
            pts = curve_to_polyline_pts(item)
            if pts and len(pts) >= 2:
                mill_list.append(pts)

    # 5. Process Drill / Alignment Points (supports list or grafted DataTree)
    pts_list = []
    if points_input is not None:
        flat_pts = flatten_input(points_input)
        for item in flat_pts:
            xy = point_to_xy(item)
            if xy:
                pts_list.append(xy)

    # 6. Process Labels
    label_items = []
    if labels_input is not None:
        flat_labels = flatten_input(labels_input)
        flat_pos = flatten_input(label_pts_input) if label_pts_input is not None else []

        for i, txt in enumerate(flat_labels):
            if txt:
                pos = [200, 200]
                if i < len(flat_pos) and flat_pos[i]:
                    xy = point_to_xy(flat_pos[i])
                    if xy:
                        pos = xy
                label_items.append({"text": str(txt), "pos": pos})

    # 7. Stroke Thicknesses & Sizes (Safely unwraps any DataTree / Int32 / float slider)
    cut_th = to_int(globals().get("cut_thickness", globals().get("cut_width", 3)), 3)
    mill_th = to_int(globals().get("mill_thickness", globals().get("mill_width", 2)), 2)
    timber_th = to_int(globals().get("timber_thickness_px", globals().get("timber_width", 2)), 2)
    drill_rad = to_int(globals().get("drill_size", globals().get("point_size", globals().get("drill_radius", 6))), 6)
    label_sz = to_float(globals().get("label_scale", globals().get("text_size", 0.45)), 0.45)

    # Filled hand drawing: each closed curve is an independent solid polygon.
    hand_drawing_list = []
    hand_drawing_skipped = 0
    for item in flatten_input(hand_drawing_input):
        try:
            polygon = closed_curve_to_polygon(item)
        except Exception:
            polygon = []
        if polygon:
            hand_drawing_list.append(polygon)
        else:
            hand_drawing_skipped += 1

    # 8. Construct Payload
    payload = {
        "timestamp": time.time(),
        "hand_drawing_geo": hand_drawing_list,
        "hand_drawing_color": hand_drawing_rgb,
        "hand_drawing_fill": True,
        "thickness_mm": thickness_val,
        "timber_contour": contour_list,
        "timber_color": timber_rgb,
        "timber_thickness_px": timber_th,
        "cut_geo": cut_list,
        "cut_color": cut_rgb,
        "cut_thickness_px": cut_th,
        "mill_geo": mill_list,
        "mill_color": mill_rgb,
        "mill_thickness_px": mill_th,
        "points_geo": pts_list,
        "point_color": point_rgb,
        "drill_radius_px": drill_rad,
        "labels": label_items,
        "label_color": label_rgb,
        "label_scale": label_sz
    }

    # 9. Send JSON frame via TCP Socket
    json_bytes = (json.dumps(payload) + "\n").encode("utf-8")
    sock = None
    try:
        sock = socket.socket(socket.AF_INET, socket.SOCK_STREAM)
        sock.settimeout(0.2)
        sock.connect((target_host, target_port))
        sock.sendall(json_bytes)
        sock.close()

        now_str = datetime.datetime.now().strftime("%H:%M:%S")
        status = (
            f"[LIVE OK {now_str}] -> {target_host}:{target_port} | "
            f"Contours: {len(contour_list)} | Cuts: {len(cut_list)} | "
            f"Mills: {len(mill_list)} | Holes: {len(pts_list)} | Labels: {len(label_items)} | "
            f"Filled drawings: {len(hand_drawing_list)} | Skipped drawings: {hand_drawing_skipped}"
        )
    except socket.timeout:
        status = f"Timeout connecting to Projector Live Viewer at {target_host}:{target_port}"
    except socket.error as e:
        status = f"Waiting for Projector Live Viewer on {target_host}:{target_port}... ({e})"
    except Exception as e:
        status = f"Error streaming data: {e}"
    finally:
        if sock:
            try:
                sock.close()
            except Exception:
                pass
# ---------- end projector_live_sender ----------

supp_6 = SupportKaramba3D(PosInd=cull_6, Ct_kN_m=Vector(0, 0, 0), Cr_kNm_rad=Vector(0, 0, 0), menu=[buttons(off, on, off, on, off, off)])  # disabled
supp_7 = SupportKaramba3D(PosInd=difference, Ct_kN_m=Vector(0, 0, 0), Cr_kNm_rad=Vector(0, 0, 0), menu=[buttons(on, off, off, off, on, off)])  # disabled
support_2 = SupportKaramba3D(flatten([supp_3, supp_7, supp_6]))  # disabled

# ---- group: Assemble Model (Karamba3D)
assemble_3 = AssembleModelKaramba3D(Elem=element_2, Support=flatten(support_2), Load=gravity_2, LimitDistance_m=0.005)  # -> Model, Info, Mass_kg, CentreOfGravity, LoadCaseNames; disabled

# ---- group: Analyse (Karamba3D)
analyse_3 = AnalyseKaramba3D(Model=assemble_3.Model)  # -> AnalysedModel, MaximumDisplacement_cm, ResultingForce_kN, ChangeOfElasticEnergy_kNm; disabled

# ---- group: Model View (Karamba3D)
modelview_2 = ModelViewKaramba3D(Model=analyse_3.AnalysedModel)  # -> Model, DeformedMesh, DeformedAxes, DeformedModel, MaximumDeformation; disabled

# ---- group: Beam View (Karamba3D)
beamview_2 = BeamViewKaramba3D(Model=modelview_2.Model)  # -> Model, MeshesOfRenderedBeams, DeformedBeamAxes, LegendColours, LegendTags; disabled

# ---- group: Shell View (Karamba3D)
shellview_2 = ShellViewKaramba3D(Model=modelview_2.Model, IndexOfLayer=0)  # -> Model, MeshesOfRenderedShells, LegendColours, LegendTags; disabled

# ----
model_2 = ModelKaramba3D(analyse_3.AnalysedModel)  # disabled
princmoment_4 = LineResultsOnShellsKaramba3D(
    AnalysedModel=model_2,
    ListOfSourcesOfForceFlowLinesLinesPoints=divide_2.Points,
    SegmentLength_m=0.5,
    DA_deg=5,
    mode="PrincMoment")  # -> Model, Lines1, Lines2; disabled
param_viewer = ParamViewer(princmoment_4.Lines2)  # disabled
tree_statistics = TreeStatistics(Tree=princmoment_4.Lines2)  # -> Paths, Length, Count; disabled
tree_statistics_2 = TreeStatistics(Tree=princmoment_4.Lines2)  # -> Paths, Length, Count; disabled
tree_statistics_3 = TreeStatistics(Tree=princmoment_4.Lines2)  # -> Paths, Length, Count; disabled
tree_statistics_4 = TreeStatistics(Tree=princmoment_4.Lines2)  # -> Paths, Length, Count; disabled
tree_statistics_5 = TreeStatistics(Tree=princmoment_4.Lines2)  # -> Paths, Length, Count; disabled
tree_statistics_6 = TreeStatistics(Tree=princmoment_4.Lines2)  # -> Paths, Length, Count; disabled
tree_statistics_7 = TreeStatistics(Tree=princmoment_4.Lines2)  # -> Paths, Length, Count; disabled
tree_statistics_8 = TreeStatistics(Tree=princmoment_4.Lines2)  # -> Paths, Length, Count; disabled
tree_statistics_9 = TreeStatistics(Tree=princmoment_4.Lines2)  # -> Paths, Length, Count; disabled
tree_statistics_10 = TreeStatistics(Tree=princmoment_4.Lines2)  # -> Paths, Length, Count; disabled
tree_statistics_11 = TreeStatistics(Tree=princmoment_4.Lines2)  # -> Paths, Length, Count; disabled
tree_statistics_12 = TreeStatistics(Tree=princmoment_4.Lines2)  # -> Paths, Length, Count; disabled
tree_statistics_13 = TreeStatistics(Tree=princmoment_4.Lines2)  # -> Paths, Length, Count; disabled
tree_statistics_14 = TreeStatistics(Tree=princmoment_4.Lines2)  # -> Paths, Length, Count; disabled
tree_statistics_15 = TreeStatistics(Tree=princmoment_4.Lines2)  # -> Paths, Length, Count; disabled
tree_statistics_16 = TreeStatistics(Tree=princmoment_4.Lines2)  # -> Paths, Length, Count; disabled
tree_statistics_17 = TreeStatistics(Tree=princmoment_4.Lines2)  # -> Paths, Length, Count; disabled
tree_statistics_18 = TreeStatistics(Tree=princmoment_4.Lines2)  # -> Paths, Length, Count; disabled
tree_statistics_19 = TreeStatistics(Tree=princmoment_4.Lines2)  # -> Paths, Length, Count; disabled
tree_statistics_20 = TreeStatistics(Tree=princmoment_4.Lines2)  # -> Paths, Length, Count; disabled
list_item = ListItem(List=tree_statistics.Paths, Index=number_slider_31, Wrap=True)  # disabled
list_item_2 = ListItem(List=tree_statistics_2.Paths, Index=number_slider_32, Wrap=True)  # disabled
list_item_3 = ListItem(List=tree_statistics_3.Paths, Index=number_slider_33, Wrap=True)  # disabled
list_item_4 = ListItem(List=tree_statistics_4.Paths, Index=number_slider_34, Wrap=True)  # disabled
list_item_5 = ListItem(List=tree_statistics_5.Paths, Index=number_slider_35, Wrap=True)  # disabled
list_item_6 = ListItem(List=tree_statistics_6.Paths, Index=number_slider_36, Wrap=True)  # disabled
list_item_7 = ListItem(List=tree_statistics_7.Paths, Index=number_slider_37, Wrap=True)  # disabled
list_item_8 = ListItem(List=tree_statistics_8.Paths, Index=number_slider_38, Wrap=True)  # disabled
list_item_9 = ListItem(List=tree_statistics_9.Paths, Index=number_slider_39, Wrap=True)  # disabled
list_item_10 = ListItem(List=tree_statistics_10.Paths, Index=number_slider_40, Wrap=True)  # disabled
list_item_11 = ListItem(List=tree_statistics_11.Paths, Index=number_slider_41, Wrap=True)  # disabled
list_item_12 = ListItem(List=tree_statistics_12.Paths, Index=number_slider_42, Wrap=True)  # disabled
tree_branch_5 = TreeBranch(Tree=princmoment_4.Lines2, Path=list_item, MaintainPaths=True)  # disabled
tree_branch_6 = TreeBranch(Tree=princmoment_4.Lines2, Path=list_item_2, MaintainPaths=True)  # disabled
tree_branch_7 = TreeBranch(Tree=princmoment_4.Lines2, Path=list_item_3, MaintainPaths=True)  # disabled
tree_branch_8 = TreeBranch(Tree=princmoment_4.Lines2, Path=list_item_4, MaintainPaths=True)  # disabled
list_item_13 = ListItem(List=tree_statistics_13.Paths, Index=number_slider_46, Wrap=True)  # disabled
list_item_14 = ListItem(List=tree_statistics_14.Paths, Index=number_slider_48, Wrap=True)  # disabled
list_item_15 = ListItem(List=tree_statistics_15.Paths, Index=number_slider_47, Wrap=True)  # disabled
list_item_16 = ListItem(List=tree_statistics_16.Paths, Index=number_slider_49, Wrap=True)  # disabled
list_item_17 = ListItem(List=tree_statistics_17.Paths, Index=number_slider_51, Wrap=True)  # disabled
list_item_18 = ListItem(List=tree_statistics_18.Paths, Index=number_slider_53, Wrap=True)  # disabled
list_item_19 = ListItem(List=tree_statistics_19.Paths, Index=number_slider_52, Wrap=True)  # disabled
list_item_20 = ListItem(List=tree_statistics_20.Paths, Index=number_slider_54, Wrap=True)  # disabled
tree_branch_9 = TreeBranch(Tree=princmoment_4.Lines2, Path=list_item_5, MaintainPaths=True)  # disabled
tree_branch_10 = TreeBranch(Tree=princmoment_4.Lines2, Path=list_item_6, MaintainPaths=True)  # disabled
tree_branch_11 = TreeBranch(Tree=princmoment_4.Lines2, Path=list_item_7, MaintainPaths=True)  # disabled
tree_branch_12 = TreeBranch(Tree=princmoment_4.Lines2, Path=list_item_8, MaintainPaths=True)  # disabled
tree_branch_13 = TreeBranch(Tree=princmoment_4.Lines2, Path=list_item_9, MaintainPaths=True)  # disabled
tree_branch_14 = TreeBranch(Tree=princmoment_4.Lines2, Path=list_item_10, MaintainPaths=True)  # disabled
tree_branch_15 = TreeBranch(Tree=princmoment_4.Lines2, Path=list_item_11, MaintainPaths=True)  # disabled
tree_branch_16 = TreeBranch(Tree=princmoment_4.Lines2, Path=list_item_12, MaintainPaths=True)  # disabled
join_curves_7 = JoinCurves(Curves=tree_branch_5, Preserve=False)  # disabled
join_curves_8 = JoinCurves(Curves=tree_branch_6, Preserve=False)  # disabled
join_curves_9 = JoinCurves(Curves=tree_branch_7, Preserve=False)  # disabled
join_curves_10 = JoinCurves(Curves=tree_branch_8, Preserve=False)  # disabled
tree_branch_17 = TreeBranch(Tree=princmoment_4.Lines2, Path=list_item_13, MaintainPaths=True)  # disabled
tree_branch_18 = TreeBranch(Tree=princmoment_4.Lines2, Path=list_item_14, MaintainPaths=True)  # disabled
tree_branch_19 = TreeBranch(Tree=princmoment_4.Lines2, Path=list_item_15, MaintainPaths=True)  # disabled
tree_branch_20 = TreeBranch(Tree=princmoment_4.Lines2, Path=list_item_16, MaintainPaths=True)  # disabled
tree_branch_21 = TreeBranch(Tree=princmoment_4.Lines2, Path=list_item_17, MaintainPaths=True)  # disabled
tree_branch_22 = TreeBranch(Tree=princmoment_4.Lines2, Path=list_item_18, MaintainPaths=True)  # disabled
tree_branch_23 = TreeBranch(Tree=princmoment_4.Lines2, Path=list_item_19, MaintainPaths=True)  # disabled
tree_branch_24 = TreeBranch(Tree=princmoment_4.Lines2, Path=list_item_20, MaintainPaths=True)  # disabled
join_curves_11 = JoinCurves(Curves=tree_branch_9, Preserve=False)  # disabled
join_curves_12 = JoinCurves(Curves=tree_branch_10, Preserve=False)  # disabled
join_curves_13 = JoinCurves(Curves=tree_branch_11, Preserve=False)  # disabled
join_curves_14 = JoinCurves(Curves=tree_branch_12, Preserve=False)  # disabled
join_curves_15 = JoinCurves(Curves=tree_branch_13, Preserve=False)  # disabled
join_curves_16 = JoinCurves(Curves=tree_branch_14, Preserve=False)  # disabled
join_curves_17 = JoinCurves(Curves=tree_branch_15, Preserve=False)  # disabled
join_curves_18 = JoinCurves(Curves=tree_branch_16, Preserve=False)  # disabled
princmoment_5 = LineResultsOnShellsKaramba3D(
    AnalysedModel=model_2,
    ListOfSourcesOfForceFlowLinesLinesPoints=eval_2.Point,
    SegmentLength_m=0.5,
    DA_deg=5,
    mode="PrincMoment")  # -> Model, Lines1, Lines2; disabled
join_curves_19 = JoinCurves(Curves=tree_branch_17, Preserve=False)  # disabled
join_curves_20 = JoinCurves(Curves=tree_branch_18, Preserve=False)  # disabled
join_curves_21 = JoinCurves(Curves=tree_branch_19, Preserve=False)  # disabled
join_curves_22 = JoinCurves(Curves=tree_branch_21, Preserve=False)  # disabled
join_curves_23 = JoinCurves(Curves=tree_branch_22, Preserve=False)  # disabled
join_curves_24 = JoinCurves(Curves=tree_branch_23, Preserve=False)  # disabled
join_curves_25 = JoinCurves(Curves=tree_branch_20, Preserve=False)  # disabled
join_curves_26 = JoinCurves(Curves=tree_branch_24, Preserve=False)  # disabled
merge_3 = Merge(
    Data1=join_curves_7,
    Data2=join_curves_9,
    Data3=join_curves_8,
    Data4=join_curves_10,
    Data5=join_curves_11,
    Data6=join_curves_12,
    Data7=join_curves_13,
    Data8=join_curves_14,
    Data9=join_curves_15,
    Data10=join_curves_16,
    Data11=join_curves_17,
    Data12=join_curves_18)  # disabled
merge_4 = Merge(
    Data1=join_curves_19,
    Data2=join_curves_22,
    Data3=join_curves_21,
    Data4=join_curves_24,
    Data5=join_curves_20,
    Data6=join_curves_23)  # disabled
tree_statistics_21 = TreeStatistics(Tree=princmoment_4.Lines1)  # -> Paths, Length, Count; disabled
tree_statistics_22 = TreeStatistics(Tree=princmoment_4.Lines1)  # -> Paths, Length, Count; disabled
tree_statistics_23 = TreeStatistics(Tree=princmoment_4.Lines1)  # -> Paths, Length, Count; disabled
tree_statistics_24 = TreeStatistics(Tree=princmoment_4.Lines1)  # -> Paths, Length, Count; disabled
tree_statistics_25 = TreeStatistics(Tree=princmoment_4.Lines1)  # -> Paths, Length, Count; disabled
tree_statistics_26 = TreeStatistics(Tree=princmoment_4.Lines1)  # -> Paths, Length, Count; disabled
tree_statistics_27 = TreeStatistics(Tree=princmoment_4.Lines1)  # -> Paths, Length, Count; disabled
tree_statistics_28 = TreeStatistics(Tree=princmoment_4.Lines1)  # -> Paths, Length, Count; disabled
tree_statistics_29 = TreeStatistics(Tree=princmoment_4.Lines1)  # -> Paths, Length, Count; disabled
tree_statistics_30 = TreeStatistics(Tree=princmoment_4.Lines1)  # -> Paths, Length, Count; disabled
tree_statistics_31 = TreeStatistics(Tree=princmoment_4.Lines1)  # -> Paths, Length, Count; disabled
tree_statistics_32 = TreeStatistics(Tree=princmoment_4.Lines1)  # -> Paths, Length, Count; disabled
tree_statistics_33 = TreeStatistics(Tree=princmoment_4.Lines1)  # -> Paths, Length, Count; disabled
tree_statistics_34 = TreeStatistics(Tree=princmoment_4.Lines1)  # -> Paths, Length, Count; disabled
tree_statistics_35 = TreeStatistics(Tree=princmoment_4.Lines1)  # -> Paths, Length, Count; disabled
tree_statistics_36 = TreeStatistics(Tree=princmoment_4.Lines1)  # -> Paths, Length, Count; disabled
tree_statistics_37 = TreeStatistics(Tree=princmoment_4.Lines1)  # -> Paths, Length, Count; disabled
tree_statistics_38 = TreeStatistics(Tree=princmoment_4.Lines1)  # -> Paths, Length, Count; disabled
list_item_21 = ListItem(List=tree_statistics_21.Paths, Index=number_slider_57, Wrap=True)  # disabled
list_item_22 = ListItem(List=tree_statistics_22.Paths, Index=number_slider_58, Wrap=True)  # disabled
list_item_23 = ListItem(List=tree_statistics_23.Paths, Index=number_slider_59, Wrap=True)  # disabled
list_item_24 = ListItem(List=tree_statistics_24.Paths, Index=number_slider_60, Wrap=True)  # disabled
list_item_25 = ListItem(List=tree_statistics_25.Paths, Index=number_slider_61, Wrap=True)  # disabled
list_item_26 = ListItem(List=tree_statistics_26.Paths, Index=number_slider_62, Wrap=True)  # disabled
list_item_27 = ListItem(List=tree_statistics_27.Paths, Index=number_slider_63, Wrap=True)  # disabled
list_item_28 = ListItem(List=tree_statistics_28.Paths, Index=number_slider_64, Wrap=True)  # disabled
list_item_29 = ListItem(List=tree_statistics_29.Paths, Index=number_slider_66, Wrap=True)  # disabled
list_item_30 = ListItem(List=tree_statistics_30.Paths, Index=number_slider_65, Wrap=True)  # disabled
list_item_31 = ListItem(List=tree_statistics_31.Paths, Index=number_slider_67, Wrap=True)  # disabled
list_item_32 = ListItem(List=tree_statistics_32.Paths, Index=number_slider_68, Wrap=True)  # disabled
list_item_33 = ListItem(List=tree_statistics_33.Paths, Index=number_slider_69, Wrap=True)  # disabled
list_item_34 = ListItem(List=tree_statistics_34.Paths, Index=number_slider_70, Wrap=True)  # disabled
list_item_35 = ListItem(List=tree_statistics_35.Paths, Index=number_slider_71, Wrap=True)  # disabled
list_item_36 = ListItem(List=tree_statistics_36.Paths, Index=number_slider_72, Wrap=True)  # disabled
list_item_37 = ListItem(List=tree_statistics_37.Paths, Index=number_slider_73, Wrap=True)  # disabled
list_item_38 = ListItem(List=tree_statistics_38.Paths, Index=number_slider_74, Wrap=True)  # disabled
tree_branch_25 = TreeBranch(Tree=princmoment_4.Lines1, Path=list_item_21, MaintainPaths=True)  # disabled
tree_branch_26 = TreeBranch(Tree=princmoment_4.Lines1, Path=list_item_22, MaintainPaths=True)  # disabled
tree_branch_27 = TreeBranch(Tree=princmoment_4.Lines1, Path=list_item_23, MaintainPaths=True)  # disabled
tree_branch_28 = TreeBranch(Tree=princmoment_4.Lines1, Path=list_item_24, MaintainPaths=True)  # disabled
tree_branch_29 = TreeBranch(Tree=princmoment_4.Lines1, Path=list_item_25, MaintainPaths=True)  # disabled
tree_branch_30 = TreeBranch(Tree=princmoment_4.Lines1, Path=list_item_26, MaintainPaths=True)  # disabled
tree_branch_31 = TreeBranch(Tree=princmoment_4.Lines1, Path=list_item_27, MaintainPaths=True)  # disabled
tree_branch_32 = TreeBranch(Tree=princmoment_4.Lines1, Path=list_item_28, MaintainPaths=True)  # disabled
tree_branch_33 = TreeBranch(Tree=princmoment_4.Lines1, Path=list_item_29, MaintainPaths=True)  # disabled
tree_branch_34 = TreeBranch(Tree=princmoment_4.Lines1, Path=list_item_30, MaintainPaths=True)  # disabled
tree_branch_35 = TreeBranch(Tree=princmoment_4.Lines1, Path=list_item_31, MaintainPaths=True)  # disabled
tree_branch_36 = TreeBranch(Tree=princmoment_4.Lines1, Path=list_item_32, MaintainPaths=True)  # disabled
tree_branch_37 = TreeBranch(Tree=princmoment_4.Lines1, Path=list_item_33, MaintainPaths=True)  # disabled
tree_branch_38 = TreeBranch(Tree=princmoment_4.Lines1, Path=list_item_34, MaintainPaths=True)  # disabled
tree_branch_39 = TreeBranch(Tree=princmoment_4.Lines1, Path=list_item_35, MaintainPaths=True)  # disabled
tree_branch_40 = TreeBranch(Tree=princmoment_4.Lines1, Path=list_item_36, MaintainPaths=True)  # disabled
tree_branch_41 = TreeBranch(Tree=princmoment_4.Lines1, Path=list_item_37, MaintainPaths=True)  # disabled
tree_branch_42 = TreeBranch(Tree=princmoment_4.Lines1, Path=list_item_38, MaintainPaths=True)  # disabled
join_curves_27 = JoinCurves(Curves=tree_branch_25, Preserve=False)  # disabled
join_curves_28 = JoinCurves(Curves=tree_branch_26, Preserve=False)  # disabled
join_curves_29 = JoinCurves(Curves=tree_branch_27, Preserve=False)  # disabled
join_curves_30 = JoinCurves(Curves=tree_branch_28, Preserve=False)  # disabled
join_curves_31 = JoinCurves(Curves=tree_branch_29, Preserve=False)  # disabled
join_curves_32 = JoinCurves(Curves=tree_branch_30, Preserve=False)  # disabled
join_curves_33 = JoinCurves(Curves=tree_branch_33, Preserve=False)  # disabled
join_curves_34 = JoinCurves(Curves=tree_branch_31, Preserve=False)  # disabled
join_curves_35 = JoinCurves(Curves=tree_branch_32, Preserve=False)  # disabled
join_curves_36 = JoinCurves(Curves=tree_branch_34, Preserve=False)  # disabled
join_curves_37 = JoinCurves(Curves=tree_branch_36, Preserve=False)  # disabled
join_curves_38 = JoinCurves(Curves=tree_branch_35, Preserve=False)  # disabled
join_curves_39 = JoinCurves(Curves=tree_branch_37, Preserve=False)  # disabled
join_curves_40 = JoinCurves(Curves=tree_branch_38, Preserve=False)  # disabled
join_curves_41 = JoinCurves(Curves=tree_branch_39, Preserve=False)  # disabled
join_curves_42 = JoinCurves(Curves=tree_branch_40, Preserve=False)  # disabled
join_curves_43 = JoinCurves(Curves=tree_branch_41, Preserve=False)  # disabled
join_curves_44 = JoinCurves(Curves=tree_branch_42, Preserve=False)  # disabled
merge_5 = Merge(
    Data1=join_curves_27,
    Data2=join_curves_28,
    Data3=join_curves_29,
    Data4=join_curves_30,
    Data5=join_curves_32,
    Data6=join_curves_36)  # disabled
merge_6 = Merge(
    Data1=join_curves_34,
    Data2=join_curves_38,
    Data3=join_curves_31,
    Data4=join_curves_35,
    Data5=join_curves_33,
    Data6=join_curves_37)  # disabled
merge_7 = Merge(
    Data1=join_curves_39,
    Data2=join_curves_40,
    Data3=join_curves_41,
    Data4=join_curves_42,
    Data5=join_curves_43,
    Data6=join_curves_44)  # disabled
merge_8 = Merge(Data1=merge_4, Data2=merge_3)  # disabled
group_5 = Group(Geometry=flatten(merge_8))  # disabled
scale_9 = Scale(Geometry=group_5, Center=area_3.Centroid, Factor=number_slider_55)  # -> Geometry, Transform; disabled
ungroup_5 = Ungroup(Group=scale_9.Geometry)  # disabled
join_curves_45 = JoinCurves(Curves=ungroup_5, Preserve=False)  # disabled
simplify_curve_3 = SimplifyCurve(Curve=join_curves_45, Tolerance=number_slider_76, AngleTolerance=radians_2)  # -> Curve, Simplified; disabled
explode_7 = Explode(Curve=simplify_curve_3.Curve, Recursive=True)  # -> Segments, Vertices; disabled
discrete_polyline_3 = DiscretePolyline(References=explode_7.Vertices, Targets=vector_star_4.Vectors, KeepLength=False)  # disabled
merge_9 = Merge(Data1=merge_5, Data2=merge_6, Data3=merge_7)  # disabled
group_6 = Group(Geometry=flatten(merge_9))  # disabled
scale_10 = Scale(Geometry=group_6, Center=area_3.Centroid, Factor=number_slider_55)  # -> Geometry, Transform; disabled
ungroup_6 = Ungroup(Group=scale_10.Geometry)  # disabled
join_curves_46 = JoinCurves(Curves=ungroup_6, Preserve=False)  # disabled
simplify_curve_4 = SimplifyCurve(Curve=join_curves_46, Tolerance=number_slider_76, AngleTolerance=radians_2)  # -> Curve, Simplified; disabled
explode_8 = Explode(Curve=simplify_curve_4.Curve, Recursive=True)  # -> Segments, Vertices; disabled
discrete_polyline_4 = DiscretePolyline(References=explode_8.Vertices, Targets=vector_star_3.Vectors, KeepLength=False)  # disabled
clean_overlapping_curves_3 = CleanOverlappingCurves(Curves=discrete_polyline_3, Distance=number_slider_79, LimitLength=2, OverSampling=5, Method=value_list_2)  # -> Curves, Polylines; disabled
clean_overlapping_curves_4 = CleanOverlappingCurves(Curves=discrete_polyline_4, Distance=number_slider_79, LimitLength=2, OverSampling=5, Method=value_list_2)  # -> Curves, Polylines; disabled
merge_10 = Merge(Data1=merge_8, Data2=merge_9)  # disabled
scale_11 = Scale(Geometry=merge_10, Center=area_3.Centroid, Factor=number_slider_56)  # -> flatten(Geometry), Transform; disabled
length_3 = Length(Curve=clean_overlapping_curves_3.Curves)  # disabled
length_4 = Length(Curve=clean_overlapping_curves_4.Curves)  # disabled
larger_than_3 = LargerThan(FirstNumber=length_3, SecondNumber=number_slider_80)  # -> LargerThan, OrEqualTo; disabled
larger_than_4 = LargerThan(FirstNumber=length_4, SecondNumber=number_slider_80)  # -> LargerThan, OrEqualTo; disabled
cull_pattern_3 = CullPattern(List=clean_overlapping_curves_3.Curves, CullPattern=larger_than_3.LargerThan)  # disabled
cull_pattern_4 = CullPattern(List=clean_overlapping_curves_4.Curves, CullPattern=larger_than_4.LargerThan)  # disabled
merge_11 = Merge(Data1=cull_pattern_3, Data2=cull_pattern_4)  # disabled
